# Grasshopper definition i665_170727.gh (Grasshopper 0.9.76)
# plug-ins: Python Interpreter, Octopus

number_slider = Slider(16, range=0..19)
number_slider_2 = Slider(11, range=11..55)
number_slider_3 = Slider(7, range=5..9)
number_slider_4 = Slider(59, range=0..100)
number_slider_5 = Slider(27, range=0..100)
number_slider_6 = Slider(61, range=0..100)
floor_height = Integer(3)
fol = Integer(number_slider_2)
y = Integer(number_slider_3)
r = Integer(number_slider)
res = Integer(number_slider_4)
com = Integer(number_slider_5)
off = Integer(number_slider_6)
walkshed_radius = Integer(Slider(400, range=0..1000))
cell_size = Integer(Slider(100, range=0..100))
# B) instructions for shaded PV analysis
# ---------------------------------------
# 
# 
# Repeat all five steps from unshaded PV analysis tutorial (input surface, check its direction, define and input DC-to-AC derate factor), input .epw weather data, run).
# 
# 1) Input the .epw file path to "Sunpath Shading" component.
# 
# 2) Input the surface to "Sunpath Shading" component.
# 
# 3) Input context and context coniferous and deciduous context trees objects. (This step has already been done, for the sake of showing which objects should be inputted to which inputs).
# 
# 4) Input the "ACenergyPerHour" output data from Photovoltaics surface to "_ACenergyPerHour" input of "Sunpath Shading" component.
# 
# 5) Run the "Sunpath Shading" component.
# 
# 
# Now we have calculated the shading value, and we need to use it to recalculate our annual electricity production
# 
# 6) Input the "annualShading" output data (of "Sunpath Shading" component) to "annualShading_" input of "DC-to-AC derate factor component".
# 
# 7) Input the .epw file path to "Photovoltaics surface" component at the far right of the definition.
# 
# 8) Input the surface to "Photovoltaics surface" component at the far right of the definition.
# 
# 9) Input the "DCtoACderateFactor" output of "DC to AC derate factor" factor to "DCtoACderateFactor_" input of the "Photovoltaics surface" component.
# 
# 10) Run the "Photovoltaics surface" component.
panel = Panel("c:/ladybug")
multiplication = Multiplication(Fol=fol, B=floor_height)
multiplication_2 = Multiplication(A=y, B=10)
multiplication_3 = Multiplication(A=r, B=10)
far_max = Integer(Slider(25, range=3..25))
far_min = Integer(Slider(3, range=3..13))
scr = Number(Slider(0.45, range=0..1))
k = Integer(Slider(5, range=0..89))
ladybug = Ladybug_Ladybug(defaultFolder=panel)  # -> Vviiiiiiiiiizzz; plug-in component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
d = Integer(multiplication)
r_2 = Integer(multiplication_3)
w = Integer(multiplication_2)
com_2 = Integer(com)
ma = MassAddition(Input=[res, com, off])  # -> Result, PartialResults
res_2 = Integer(res)
sqr = Square(Value=cell_size)
tan = Tangent(Value=degrees(k))
division = Division(A=cell_size, B=2)
rectangle = Rectangle(Plane=PlaneXY(0, 0, 0), XSize=cell_size, YSize=cell_size, Radius=0)  # -> Rectangle, Length
division_2 = Division(A=walkshed_radius, B=100)
multiplication_4 = Multiplication(A=scr, B=sqr)
subtraction = Subtraction(A=walkshed_radius, B=division)
division_3 = Division(A=res_2, B=ma.Result)
division_4 = Division(A=com_2, B=ma.Result)
crv = Curve(rectangle.Rectangle)
multiplication_5 = Multiplication(A=division_2, B=2)
bldg_footprint_area = Integer(multiplication_4)
boundary = BoundarySurfaces(Edges=crv)
multiplication_6 = Multiplication(A=multiplication_5, B=cell_size)
multiplication_7 = Multiplication(A=tan, B=subtraction)
addition = Addition(A=division_3, B=division_4)
y_peak_d = Integer(multiplication_7)
series = Series(Start=0, Step=cell_size, Count=multiplication_5)
com_weekday_hourly = Number([8.855916732, 8.855916732, 8.855916732, 8.855916732, 8.855916732, 8.855916732, 52.14358796, 75.15621103, 76.67352684, 77.68507071, 78.19084264, 79.45527248, 79.96104442, 80.46681635, 80.97258829, 80.46681635, 80.46681635, 83.75433393, 84.51299184, 84.51299184, 54.1421364, 53.13059253, 52.37193463, 8.603030764])
com_weekend_hourly = Number([8.855916732, 8.855916732, 8.855916732, 8.855916732, 8.855916732, 8.855916732, 52.14358796, 75.15621103, 76.67352684, 77.68507071, 78.19084264, 79.45527248, 79.96104442, 80.46681635, 80.97258829, 80.46681635, 80.46681635, 83.75433393, 84.51299184, 84.51299184, 54.1421364, 53.13059253, 52.37193463, 8.603030764])
res_weekday_hourly = Number([7.591605041, 6.445493477, 6.308552792, 5.41385195, 3.738920301, 4.418684536, 5.413743444, 4.546452439, 5.826799563, 5.096449244, 4.868214769, 4.731274084, 5.644211983, 5.324683719, 4.274805134, 4.092217555, 4.274805134, 6.219384561, 22.13131104, 23.07165878, 24.1082395, 24.20376688, 14.78729714, 13.61871493])
res_weekend_hourly = Number([8.215471232, 7.069359668, 6.932418983, 6.037718141, 4.362786492, 5.042550727, 6.037609635, 5.17031863, 4.579067181, 3.848716862, 3.620482387, 3.483541702, 4.396479601, 4.076951337, 3.027072752, 2.844485173, 3.027072752, 4.971652179, 17.14038151, 18.08072925, 19.11730997, 19.21283735, 13.53956476, 12.37098255])
division_5 = Division(A=bldg_footprint_area, B=w)
off_weekday_hourly = Number([9.539857018, 9.931905936, 9.539857018, 9.801222963, 10.45463783, 11.23873566, 13.19898026, 17.38083539, 43.61151836, 44.13425025, 44.52629917, 44.26493323, 44.78766512, 45.31039701, 45.57176295, 45.44107998, 45.3626702, 44.52629917, 22.68307809, 21.89898026, 20.98419945, 20.46146756, 12.63873566, 9.371661344])
off_weekend_hourly = Number([0, 0, 0, 0, 0, 0, 0, 0, 0, 0, 0, 0, 0, 0, 0, 0, 0, 0, 0, 0, 0, 0, 0, 0])
rectangle_2 = Rectangle(Plane=PlaneXY(0, 0, 0), XSize=multiplication_6, YSize=multiplication_6, Radius=0)  # -> Rectangle, Length
subtraction_2 = Subtraction(A=1, B=addition)
Z = UnitZ(Factor=y_peak_d)
l = Number(division_5)
X = UnitX(Factor=series)
area = Area(Geometry=rectangle_2.Rectangle)  # -> Area, Centroid
move = Move(Geometry=area.Centroid, Motion=Z)  # -> Geometry, Transform
division_6 = Division(A=l, B=2)
division_7 = Division(A=w, B=2)
res_3 = Number(division_3)
com_3 = Number(division_4)
off_2 = Number(subtraction_2)
dup = DuplicateData(Data=res_weekend_hourly, Number=2, Order=True)
series_2 = Series(Start=0, Step=cell_size, Count=multiplication_5)
move_2 = Move(Geometry=boundary, Motion=X)  # -> graft(Geometry), Transform
dup_2 = DuplicateData(Data=com_weekend_hourly, Number=2, Order=True)
dup_3 = DuplicateData(Data=off_weekend_hourly, Number=2, Order=True)
neg = Negative(Value=division_6)
neg_2 = Negative(Value=division_7)
Z_2 = UnitZ(Factor=d)
dup_4 = DuplicateData(Data=res_weekday_hourly, Number=5, Order=True)
weekly_demand_com_m2 = Number("9.211")
dup_5 = DuplicateData(Data=com_weekday_hourly, Number=5, Order=True)
weekly_demand_off_m2 = Number("3.233")
weekly_demand_res_m2 = Number("1.3")
dup_6 = DuplicateData(Data=off_weekday_hourly, Number=5, Order=True)
Y = UnitY(Factor=series_2)
cir = Circle(Plane=area.Centroid, Radius=walkshed_radius)
dom = ConstructDomain(DomainStart=division_6, DomainEnd=neg)
dom_2 = ConstructDomain(DomainStart=division_7, DomainEnd=neg_2)
bldg_footprint_area_2 = Integer(bldg_footprint_area)
walkable_radius = Curve(cir)
rotate = Rotate(Geometry=walkable_radius, Angle=degrees(r_2), Plane=PlaneXY(0, 0, 0))  # -> Geometry, Transform
walkable_radius_2 = Curve(rotate.Geometry)
extr = ExtrudePoint(Base=walkable_radius, Point=move.Geometry)
move_3 = Move(Geometry=extr, Motion=Z_2)  # -> Geometry, Transform
ins = InsertItems(List=dup_4, Item=dup, Indices=120, Wrap=True)
ins_2 = InsertItems(List=dup_5, Item=dup_2, Indices=120, Wrap=True)
move_4 = Move(Geometry=move_2.Geometry, Motion=Y)  # -> Geometry, Transform
ins_3 = InsertItems(List=dup_6, Item=dup_3, Indices=120, Wrap=True)
height_bo = Brep(move_3.Geometry)
blocks = Surface(graft(move_4.Geometry))
Z_3 = UnitZ(Factor=1)
area_2 = Area(Geometry=blocks)  # -> Area, Centroid
incurve = PointInCurve(Point=flatten(area_2.Centroid), Curve=walkable_radius)  # -> Relationship, Point
rectangle_3 = Rectangle(Plane=area_2.Centroid, XSize=Domain(-1, 1), YSize=Domain(-2, 2), Radius=0)  # -> Rectangle, Length
equals = Equality(FirstNumber=incurve.Relationship, SecondNumber=2)  # -> Equality, Inequality
cull = CullPattern(List=flatten(blocks), CullPattern=equals.Equality)
blocks_in_the_mrt_walkshed = Surface(cull)
rotate_2 = Rotate(Geometry=blocks_in_the_mrt_walkshed, Angle=degrees(r_2), Plane=PlaneXY(0, 0, 0))  # -> Geometry, Transform
area_3 = Area(Geometry=blocks_in_the_mrt_walkshed)  # -> Area, Centroid
ma_2 = MassAddition(Input=area_3.Area)  # -> Result, PartialResults
site_area = Integer(ma_2.Result)
building_centroids = Point(area_3.Centroid)
blocks_in_the_mrt_walkshed_2 = Surface(rotate_2.Geometry)
rectangle_4 = Rectangle(Plane=building_centroids, XSize=dom, YSize=dom_2, Radius=0)  # -> Rectangle, Length
boundary_2 = BoundarySurfaces(Edges=rectangle_4.Rectangle)
project = ProjectPoint(Point=building_centroids, Direction=Z_3, Geometry=height_bo)  # -> Point, Index
pdecon = Deconstruct(Point=project.Point)  # -> XComponent, YComponent, ZComponent
bldg_footprint = Surface(boundary_2)
integer_division = IntegerDivision(A=pdecon.ZComponent, B=floor_height)
of_floors = Integer(integer_division)
multiplication_8 = Multiplication(A=of_floors, B=scr)
ma_3 = MassAddition(Input=of_floors)  # -> Result, PartialResults
far = Number(multiplication_8)
sort = SortList(Keys=far)  # -> Keys, ValuesA
item = ListItem(List=sort.Keys, Index=0, Wrap=True)
min_far = Number(item)
multiplication_9 = Multiplication(A=ma_3.Result, B=bldg_footprint_area)
larger = LargerThan(FirstNumber=min_far, SecondNumber=far_min)  # -> LargerThan, OrEqualTo
rev = ReverseList(List=sort.Keys)
item_2 = ListItem(List=rev, Index=0, Wrap=True)
max_far = Number(item_2)
smaller = SmallerThan(FirstNumber=max_far, SecondNumber=far_max)  # -> SmallerThan, OrEqualTo
division_8 = Division(A=multiplication_9, B=site_area)
and = GateAnd(A=larger.OrEqualTo, B=smaller.OrEqualTo)
gfa = Number(multiplication_9)
far_2 = Number(division_8)
cull_2 = CullPattern(List=gfa, CullPattern=and)
cull_3 = CullPattern(List=far_2, CullPattern=and)
gfa_tested = Number(cull_2)
multiplication_10 = Multiplication(A=gfa_tested, B=res_3)
multiplication_11 = Multiplication(A=gfa_tested, B=com_3)
multiplication_12 = Multiplication(A=gfa_tested, B=off_2)
far_tested = Number(cull_3)
gfa_com = Number(multiplication_11)
gfa_res = Number(multiplication_10)
gfa_off = Number(multiplication_12)
integer_division_2 = IntegerDivision(A=gfa_com, B=bldg_footprint_area_2)
integer_division_3 = IntegerDivision(A=gfa_off, B=bldg_footprint_area_2)
floor_com = Integer(integer_division_2)
floor_off = Integer(integer_division_3)
addition_2 = Addition(A=floor_com, B=floor_off)
multiplication_13 = Multiplication(A=gfa_res, B=ins)
multiplication_14 = Multiplication(A=gfa_com, B=ins_2)
multiplication_15 = Multiplication(A=gfa_off, B=ins_3)
multiplication_16 = Multiplication(A=integer_division, B=floor_height)
ma_4 = MassAddition(Input=integer_division)  # -> Result, PartialResults
total_floors = Integer(ma_4.Result)
subtraction_3 = Subtraction(A=total_floors, B=addition_2)
floor_res = Integer(subtraction_3)
division_9 = Division(A=multiplication_13, B=1000)
division_10 = Division(A=multiplication_15, B=1000)
division_11 = Division(A=multiplication_14, B=1000)
Z_4 = UnitZ(Factor=multiplication_16)
multiplication_17 = Multiplication(A=floor_res, B=bldg_footprint_area_2)
multiplication_18 = Multiplication(A=floor_com, B=bldg_footprint_area_2)
multiplication_19 = Multiplication(A=floor_off, B=bldg_footprint_area_2)
extr_2 = Extrude(Base=bldg_footprint, Direction=Z_4)
gfa_res_2 = Number(multiplication_17)
multiplication_20 = Multiplication(A=gfa_res_2, B=weekly_demand_res_m2)
gfa_com_2 = Number(multiplication_18)
multiplication_21 = Multiplication(A=gfa_com_2, B=weekly_demand_com_m2)
gfa_off_2 = Number(multiplication_19)
multiplication_22 = Multiplication(A=gfa_off_2, B=weekly_demand_off_m2)
ma_5 = MassAddition(Input=[multiplication_20, multiplication_21, multiplication_22])  # -> Result, PartialResults
total_electricity_demand = Number(ma_5.Result)
buildings = Brep(extr_2)
rotate_3 = Rotate(Geometry=buildings, Angle=degrees(r_2), Plane=PlaneXY(0, 0, 0))  # -> Geometry, Transform
buildings_2 = Brep(rotate_3.Geometry)
cull_4 = CullPattern(List=buildings_2, CullPattern=and)
buildings_tested = Brep(cull_4)
panel_2 = Panel("https://www.energyplus.net/weather-download/southwest_pacific_wmo_region_5/SGP//SGP_Singapore.486980_IWEC/all")
ladybug_2 = Ladybug_Ladybug()  # -> Vviiiiiiiiiizzz; plug-in component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
honeybee = Honeybee_Honeybee()  # -> Vviiiiiiiiiizzz; plug-in component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
sort_2 = SortList(Keys=integer_division)  # -> Keys, ValuesA
lng = ListLength(List=buildings)
rotate_4 = Rotate(Geometry=bldg_footprint, Angle=degrees(r_2), Plane=PlaneXY(0, 0, 0))  # -> Geometry, Transform
# from dbfpy import dbf
# 
# ## create empty DBF, set fields
# 
# path_occupancy=r'C:\UBG_to_CEA\baseline\inputs\building-properties\occupancy.dbf'
# 
# db = dbf.Dbf(path_occupancy, new=True)
# 
# db.addField(
#     ("NAME", "C", 15),
#     ("Floor_1", "C", 15),
#     ("Floor_2", "C", 15),
#     ("Floor_3", "C", 15)
# )
# 
# ## fill DBF with some records
# 
# for name, floor_1, floor_2, floor_3 in (
#     ("B01", "Commercial", "Office", "Residential"),("B02", "Commercial", "Office", "Residential")
# 
# ):
#     rec = db.newRecord()
#     rec["NAME"] = name
#     rec["Floor_1"] = floor_1
#     rec["Floor_2"] = floor_2
#     rec["Floor_3"] = floor_3
# 
#     rec.store()
# db.close()
total_buildings = Integer(lng)
total_buildings_2 = Integer(lng)
number_slider_7 = Slider(0, range=0..100)
rev_2 = ReverseList(List=sort_2.Keys)
total_buildings_3 = Integer(lng)
epw_stat = Ladybug_OpenEPWAndSTATWeatherFiles(weatherFileURL=panel_2)  # -> epwFile, statFile; plug-in component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
height_ag = Number(multiplication_16)
floors_ag = Number(integer_division)
bldg_footprint_rotated = Surface(rotate_4.Geometry)
mass2zone = Honeybee_Masses2Zones(zoneMasses=flatten(buildings_tested), isConditioned=True, maxRoofAngle=30, createHBZones=Toggle(True))  # -> readMe, HBZones; plug-in component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
item_3 = ListItem(List=rev_2, Index=0, Wrap=True)
l_2 = Integer(l)
bldg_heights = Integer(multiplication_16)
panel_3 = Panel(bldg_heights)
largest_floor_no = Number(item_3)
lng_2 = ListLength(List=bldg_heights)
dup_7 = DuplicateData(Data=l_2, Number=lng_2, Order=True)  # -> graft(Data)
dup_8 = DuplicateData(Data="\"RESIDENTIAL\"", Number=floor_res, Order=True)
dup_9 = DuplicateData(Data="\"COMMERCIAL\"", Number=floor_com, Order=True)
dup_10 = DuplicateData(Data="\"OFFICE\"", Number=floor_off, Order=True)
dup_11 = DuplicateData(Data=graft(bldg_heights), Number=expr("4", 2), Order=True)
toggle = BooleanToggle(True)
join = TextJoin(Text=["2017", ","])
series_3 = Series(Start=1, Step=1, Count="1")
series_4 = Series(Start=1, Step=1, Count="4")
series_5 = Series(Start=1, Step=1, Count="12")
series_6 = Series(Start=1, Step=1, Count="12")
edges = BrepEdges(Brep=bldg_footprint_rotated)  # -> Naked, Interior, NonManifold
lng_3 = ListLength(List=bldg_footprint_rotated)
series_7 = Series(Start=0, Step=0, Count=lng_3)
height_bg = Number(series_7)
floors_bg = Number(series_7)
w_2 = Integer(w)
win_wall = Number(Slider(1, range=0..1))
series_8 = Series(Start=1, Step=1, Count="2")
series_9 = Series(Start=1, Step=1, Count="4")
series_10 = Series(Start=1, Step=1, Count="4")
series_11 = Series(Start=1, Step=1, Count="2")
occ_m2p = Integer("14")
series_12 = Series(Start=1, Step=1, Count="2")
es = Number("0.8")
hs = Number("0.8")
n50 = Integer("2")
series_13 = Series(Start=largest_floor_no, Step=0, Count=total_buildings_3)
merge = Merge(Data1=dup_8, Data2=dup_9, Data3=dup_10)
int = Integer(series_3)
int_2 = Integer(series_4)
int_3 = Integer(series_5)
gencumulativeskymtx = Ladybug_GenCumulativeSkyMtx(epwFile=epw_stat.epwFile, skyDensity=0, useOldRes=True, runIt=Toggle(True))  # -> readMe, cumulativeSkyMtx; plug-in component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
int_4 = Integer(series_6)
ins_4 = InsertItems(List=dup_7, Item=w_2, Indices=1, Wrap=True)
series_14 = Series(Start=1, Step=1, Count=largest_floor_no)
ins_5 = InsertItems(List=dup_11, Item=w_2, Indices=4, Wrap=True)
int_5 = Integer(series_8)
series_15 = Series(Start=0, Step=1, Count=lng_3)
int_6 = Integer(series_10)
int_7 = Integer(series_9)
int_8 = Integer(series_11)
int_9 = Integer(series_12)
end = EndPoints(Curve=edges.Naked)  # -> Start, End
python = PythonScript(T="T", index=int)  # -> out, a
# ---------- python: Python ----------
print T,index
# ---------- end python ----------
python_2 = PythonScript(T="T", index=int_2)  # -> out, a; same code as python
python_3 = PythonScript(T="T", index=int_3)  # -> out, a; same code as python
python_4 = PythonScript(T="T", index=int_4)  # -> out, a; same code as python
subtraction_4 = Subtraction(A=series_13, B=integer_division)
python_5 = PythonScript(T="T", index=int_5)  # -> out, a; same code as python
python_6 = PythonScript(T="T", index=int_7)  # -> out, a; same code as python
python_7 = PythonScript(T="T", index=int_6)  # -> out, a; same code as python
python_8 = PythonScript(T="T", index=int_8)  # -> out, a; same code as python
index = Integer(series_14)
index_2 = Integer(series_15)
python_9 = PythonScript(index=index_2)  # -> out, a
# ---------- python_9: Python ----------
print "Bldg_", index
# ---------- end python_9 ----------
bldg_name = Text(python_9.out)
bldg_name_2 = Text(bldg_name)
bldg_name_3 = Text(bldg_name)
bldg_name_4 = Text(bldg_name)
python_10 = PythonScript(index=bldg_name_2)  # -> out, a
# ---------- python_10: Python ----------
print '("', index,'",'
# ---------- end python_10 ----------
python_11 = PythonScript(index=bldg_name_3)  # -> out, a; same code as python_10
python_12 = PythonScript(index=bldg_name_4)  # -> out, a; same code as python_10
python_13 = PythonScript(index=bldg_name)  # -> out, a
# ---------- python_13: Python ----------
print '("', index,'"'
# ---------- end python_13 ----------
rep = ReplaceText(Text=python_10.out, Find=" ", RecursiveReplace=False)
rep_2 = ReplaceText(Text=python_11.out, Find=" ", RecursiveReplace=False)
rep_3 = ReplaceText(Text=python_12.out, Find=" ", RecursiveReplace=False)
python_14 = PythonScript(x=rep, y=join)  # -> out, a
# ---------- python_14: Python ----------
print x,y,'"0",','"0",','"0",','"0",','"0",','"0")'
# ---------- end python_14 ----------
rep_4 = ReplaceText(Text=python_13.out, Find=" ", RecursiveReplace=False)
panel_4 = Panel(python_14.out)
python_15 = PythonScript(T="T", index=int_9)  # -> out, a; same code as python
selbytype = Honeybee_SelectByType(HBZones=mass2zone.HBZones, showWalls=toggle, showRoofs=toggle)  # -> surfaces, flatten(HBSurfaces); plug-in component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
ins_6 = InsertItems(List=ins_4, Item=l_2, Indices=2, Wrap=True)
join_2 = TextJoin(Text=flatten(python_14.out), Join=",")
lc = Deconstruct(Point=end.Start)  # -> XComponent, YComponent, ZComponent
python_16 = PythonScript(Index=index)  # -> out, a
# ---------- python_16: Python ----------
print 'FLOOR_',Index
# ---------- end python_16 ----------
python_17 = PythonScript(index=index_2)  # -> out, a
# ---------- python_17: Python ----------
print 'Coordinate_',index
# ---------- end python_17 ----------
rep_5 = ReplaceText(Text=python.out, Find=" ", RecursiveReplace=False)
ma_6 = MassAddition(Input=subtraction_4)  # -> Result, PartialResults
rep_6 = ReplaceText(Text=python_2.out, Find=" ", RecursiveReplace=False)  # -> flatten(Result)
rep_7 = ReplaceText(Text=python_3.out, Find=" ", RecursiveReplace=False)  # -> flatten(Result)
rep_8 = ReplaceText(Text=python_4.out, Find=" ", RecursiveReplace=False)  # -> flatten(Result)
panel_5 = Panel(rep_4)
rep_9 = ReplaceText(Text=python_5.out, Find=" ", RecursiveReplace=False)  # -> flatten(Result)
rep_10 = ReplaceText(Text=python_6.out, Find=" ", RecursiveReplace=False)  # -> flatten(Result)
rep_11 = ReplaceText(Text=python_7.out, Find=" ", RecursiveReplace=False)  # -> flatten(Result)
rep_12 = ReplaceText(Text=python_8.out, Find=" ", RecursiveReplace=False)  # -> flatten(Result)
rep_13 = ReplaceText(Text=python_15.out, Find=" ", RecursiveReplace=False)  # -> flatten(Result)
jitter = Jitter(List=merge, Jitter=1, Seed=Slider(100, range=0..100))  # -> Values, Indices
x_coordinates = Number(flatten(lc.XComponent))
y_coordinates = Number(flatten(lc.YComponent))
division_12 = Division(A=ins_5, B=Slider(1.1, range=0..10))
simple_inverter = Honeybee_simple_Inverter(inverterName="PVinverter", inverterCost="5000")  # -> readMe, HB_inverter; plug-in component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
selectskymtx = Ladybug_selectSkyMtx(cumulativeSkyMtx=gencumulativeskymtx.cumulativeSkyMtx, removeDiffuse=False, removeDirect=False)  # -> readMe, selectedSkyMtx; plug-in component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
ins_7 = InsertItems(List=ins_6, Item=w_2, Indices=3, Wrap=True)
type_dhw = Text(rep_8)
type_hs = Text(rep_7)
type_el = Text(rep_5)
type_cs = Text(rep_6)
panel_6 = Panel(join_2)
number_slider_8 = Slider(30, range=0..100)
number_slider_9 = Slider(30, range=0..50)
rep_14 = ReplaceText(Text=python_16.out, Find=" ", RecursiveReplace=False)
type_shade = Text(rep_9)
type_roof = Text(rep_10)
type_wall = Text(rep_11)
type_win = Text(rep_12)
rep_15 = ReplaceText(Text=python_17.out, Find=" ", RecursiveReplace=False)
land_use_list = Text(flatten(jitter.Values))
th_mass = Text(rep_13)
subtraction_5 = Subtraction(A=Slider(4, range=1..4), B=1)
subtraction_6 = Subtraction(A=Slider(4, range=1..4), B=1)
subtraction_7 = Subtraction(A=Slider(12, range=1..12), B=1)
subtraction_8 = Subtraction(A=Slider(12, range=1..12), B=1)
subtraction_9 = Subtraction(A=Slider(1, range=1..2), B=1)
geo = Geometry(selbytype.HBSurfaces)
subtraction_10 = Subtraction(A=Slider(4, range=1..4), B=1)
dup_12 = DuplicateData(Data="\" \"", Number=ma_6.Result, Order=True)  # -> flatten(Data)
subtraction_11 = Subtraction(A=Slider(4, range=1..4), B=1)
subtraction_12 = Subtraction(A=Slider(2, range=1..2), B=1)
subtraction_13 = Subtraction(A=Slider(2, range=1..2), B=1)
panel_7 = Panel(""")

## fill DBF with some records

for name""")
python_18 = PythonScript(FLOOR_n=rep_14)  # -> out, a
# ---------- python_18: Python ----------
print '("',FLOOR_n,'"',', "C", 15)'
# ---------- end python_18 ----------
panel_8 = Panel("""):
    rec = db.newRecord()
    rec["NAME"] = name""")
panel_9 = Panel("""    rec.store()
db.close()""")
ins_8 = InsertItems(List=ins_7, Item=l_2, Indices=4, Wrap=True)
python_19 = PythonScript(x=x_coordinates, y=y_coordinates)  # -> out, a
# ---------- python_19: Python ----------
print '(',x,',',y,')'
# ---------- end python_19 ----------
round = Round(Number=division_12)  # -> Nearest, flatten(Floor), Ceiling
item_4 = ListItem(List=type_el, Index=0, Wrap=True)
item_5 = ListItem(List=type_cs, Index=subtraction_6, Wrap=True)
item_6 = ListItem(List=type_hs, Index=subtraction_7, Wrap=True)
item_7 = ListItem(List=type_dhw, Index=subtraction_8, Wrap=True)
python_20 = PythonScript(index=index_2)  # -> out, a
# ---------- python_20: Python ----------
print "'","Bldg_", index,"'"
# ---------- end python_20 ----------
item_8 = ListItem(List=geo, Index=1, Wrap=True)
python_21 = PythonScript(x=floors_ag)  # -> out, a
# ---------- python_21: Python ----------
print "'",x,"'"
# ---------- end python_21 ----------
python_22 = PythonScript(x=floors_bg)  # -> out, a; same code as python_21
item_9 = ListItem(List=type_shade, Index=subtraction_9, Wrap=True)
item_10 = ListItem(List=type_roof, Index=subtraction_10, Wrap=True)
item_11 = ListItem(List=type_wall, Index=subtraction_11, Wrap=True)
python_23 = PythonScript(x=height_ag)  # -> out, a; same code as python_21
partition = PartitionList(List=land_use_list, Size=integer_division)
item_12 = ListItem(List=type_win, Index=subtraction_12, Wrap=True)
python_24 = PythonScript(x=height_bg)  # -> out, a; same code as python_21
item_13 = ListItem(List=th_mass, Index=subtraction_13, Wrap=True)
python_25 = PythonScript(index=index_2)  # -> out, a
# ---------- python_25: Python ----------
print 'Poly_',index
# ---------- end python_25 ----------
partition_2 = PartitionList(List=dup_12, Size=subtraction_4)
rep_16 = ReplaceText(Text=python_19.out, Find=" ", RecursiveReplace=False)  # -> flatten(Result)
panel_10 = Panel(round.Floor)
python_26 = PythonScript(x=rep_2, el=item_4, cs=item_5, hs=item_6, dhw=item_7)  # -> out, a
# ---------- python_26: Python ----------
print x,'"',el,'", "',cs,'","',hs,'" ,"',dhw,'")'
# ---------- end python_26 ----------
rep_17 = ReplaceText(Text=python_18.out, Find=" ", RecursiveReplace=False)
python_27 = PythonScript(
    x=rep_3,
    win_wall=win_wall,
    type_shade=item_9,
    occ_m2p=occ_m2p,
    n50=n50,
    type_roof=item_10,
    type_wall=item_11,
    type_win=item_12,
    th_mass=item_13,
    es=es,
    hs=hs)  # -> out, a
# ---------- python_27: Python ----------
print x,'"',win_wall,'","',type_shade,'","',occ_m2p,'","',n50,'","',type_roof,'","',type_wall,'","',type_win,'","',th_mass,'","',es,'","',hs,'")'
# ---------- end python_27 ----------
division_13 = Division(A=ins_8, B=Slider(2.2, range=0..10))
rep_18 = ReplaceText(Text=python_21.out, Find=" ", RecursiveReplace=False)
rep_19 = ReplaceText(Text=python_23.out, Find=" ", RecursiveReplace=False)
rep_20 = ReplaceText(Text=python_22.out, Find=" ", RecursiveReplace=False)
rep_21 = ReplaceText(Text=python_24.out, Find=" ", RecursiveReplace=False)
rep_22 = ReplaceText(Text=python_20.out, Find=" ", RecursiveReplace=False)
panel_11 = Panel(rep_22)
toggle_2 = BooleanToggle(False)
python_28 = PythonScript(FLOOR_n=rep_14)  # -> out, a
# ---------- python_28: Python ----------
print 'rec["',FLOOR_n,'"]'
# ---------- end python_28 ----------
rep_23 = ReplaceText(Text=python_25.out, Find=" ", RecursiveReplace=False)
mindex = MemberIndex(Set=partition, Member="\"RESIDENTIAL\"")  # -> Index, Count
mindex_2 = MemberIndex(Set=partition, Member="\"COMMERCIAL\"")  # -> Index, Count
mindex_3 = MemberIndex(Set=partition, Member="\"OFFICE\"")  # -> Index, Count
panel_12 = Panel("4")
partition_3 = PartitionList(List=rep_16, Size=4)
panel_13 = Panel("2")
round_2 = Round(Number=division_13)  # -> Nearest, flatten(Floor), Ceiling
join_3 = TextJoin(Text=flatten(rep_17), Join=",")
join_4 = TextJoin(Text=flatten(rep_14), Join=", ")
join_5 = TextJoin(Text=flatten(python_26.out), Join=",")
join_6 = TextJoin(Text=flatten(python_27.out), Join=",")
floors_or_com = Integer(mindex_2.Count)
floors_or_res = Integer(mindex.Count)
floors_or_off = Integer(mindex_3.Count)
join_7 = TextJoin(Text=partition_3, Join=", ")
rep_24 = ReplaceText(Text=python_28.out, Find=" ", RecursiveReplace=False)
python_29 = PythonScript(index=index_2, height_ag=flatten(rep_19))  # -> out, a
# ---------- python_29: Python ----------
print 'district.loc[',index,',',"'HEIGHT_AG' ] =", height_ag
# ---------- end python_29 ----------
python_30 = PythonScript(index=index_2, floors_ag=flatten(rep_18))  # -> out, a
# ---------- python_30: Python ----------
print 'district.loc[',index,',',"'FLOORS_AG' ] =", floors_ag
# ---------- end python_30 ----------
python_31 = PythonScript(index=index_2, height_bg=flatten(rep_21))  # -> out, a
# ---------- python_31: Python ----------
print 'district.loc[',index,',',"'HEIGHT_BG' ] =", height_bg
# ---------- end python_31 ----------
python_32 = PythonScript(index=index_2, floors_bg=flatten(rep_20))  # -> out, a
# ---------- python_32: Python ----------
print 'district.loc[',index,',',"'FLOORS_BG' ] =", floors_bg
# ---------- end python_32 ----------
python_33 = PythonScript(index=index_2, Name=flatten(rep_22))  # -> out, a
# ---------- python_33: Python ----------
print 'district.loc[',index,',',"'NAME' ] =", Name
# ---------- end python_33 ----------
panel_14 = Panel(division_13)
radiationanalysis = Ladybug_RadiationAnalysis(
    geometry=flatten(buildings_tested),
    gridSize=Slider(35, range=0..100),
    disFromBase=Slider(4, range=0..10),
    selectedSkyMtx=flatten(selectskymtx.selectedSkyMtx),
    parallel=toggle_2,
    runIt=toggle_2)  # -> readMe, contextMesh, analysisMesh, testPts, testVec, port, radiationResult, radiationMesh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; plug-in component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
python_34 = PythonScript(Coordinate_n=rep_15)  # -> out, a
# ---------- python_34: Python ----------
print 'Polygon(', Coordinate_n,')'
# ---------- end python_34 ----------
python_35 = PythonScript(index=index_2, Poly=flatten(rep_23))  # -> out, a
# ---------- python_35: Python ----------
print 'district.loc[',index,',',"'geometry' ] =", Poly
# ---------- end python_35 ----------
join_8 = TextJoin(Text=flatten([panel_7, join_4]), Join=", ")
coordinates = Text(join_7)
python_36 = PythonScript(x=rep_24, y=rep_14)  # -> flatten(out), a
# ---------- python_36: Python ----------
print '   ',x,'=',y
# ---------- end python_36 ----------
panel_15 = Panel(item_7)
pvgen = Honeybee_Generator_PV(
    name="PVgenerator",
    HBSurfaces=geo,
    cellsEfficiency="0.13",
    integrationMode="1",
    NoParallel=round.Floor,
    Noseries=round_2.Floor,
    costPVPerModule="300",
    powerOutputPerModule="300",
    PVInverter=simple_inverter.HB_inverter)  # -> readMe, PV_HBSurfaces; plug-in component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
panel_16 = Panel(item_12)
panel_17 = Panel([floors_or_res, floors_or_com, floors_or_off])
panel_18 = Panel(["\"RESIDENTIAL\"", "\"COMMERCIAL\"", "\"OFFICE\""])
repeat = RepeatData(Data="\"RESIDENTIAL\"", Length=floors_or_res)
join_9 = TextJoin(Text=[join_8, "in ("], Join=" ")
python_37 = PythonScript(Coordinates=coordinates, Coordinate_n=rep_15)  # -> out, a
# ---------- python_37: Python ----------
print Coordinate_n, '=', '[', Coordinates, ']'
# ---------- end python_37 ----------
python_38 = PythonScript(Polygon=python_34.out, Poly=rep_23)  # -> out, a
# ---------- python_38: Python ----------
print Poly, '=', Polygon
# ---------- end python_38 ----------
panel_19 = Panel(python_26.out)
panel_20 = Panel(join_5)
panel_21 = Panel(join_6)
panel_22 = Panel(python_27.out)
pt = Point(radiationanalysis.testPts)
mesh = Mesh(radiationanalysis.radiationMesh)
mesh_2 = Mesh(radiationanalysis.radiationLegend)
panel_23 = Panel(python_36.out)
join_10 = TextJoin(Text=[panel_8, python_36.out, panel_9])
total_solar_potential = Number(radiationanalysis.totalRadiation)
panel_24 = Panel(radiationanalysis.totalRadiation)
gfa_2 = Integer()
panel_25 = Panel(pvgen.readMe)
jitter_2 = Jitter(List=panel_17, Jitter=1, Seed=number_slider_7)  # -> Values, Indices
jitter_3 = Jitter(List=panel_18, Jitter=1, Seed=number_slider_7)  # -> Values, Indices
division_14 = Division(A=total_solar_potential, B=gfa_2)
stack = StackData(Data=jitter_3.Values, Stack=jitter_2.Values)
ins_9 = InsertItems(List=stack, Item=partition_2, Indices=graft(integer_division), Wrap=True)
solar_potential_m2 = Number(division_14)
subtraction_14 = Subtraction(A=largest_floor_no, B=1)
clean = CleanTree(RemoveNulls=True, RemoveInvalid=True, RemoveEmpty=False, Tree=ins_9)
generationsystem = Honeybee_generationsystem(GeneratorSystemName="PVgenerators", MaintenanceCost="300", PVHBSurfaces=pvgen.PV_HBSurfaces)  # -> readMe, HBGeneratorSystem; plug-in component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
item_14 = ListItem(List=clean, Index=subtraction_14, Wrap=True)
panel_26 = Panel(solar_potential_m2)
culln = CullNth(List=clean, CullFrequency=subtraction_14)
python_39 = PythonScript(index=item_14)  # -> flatten(out), a
# ---------- python_39: Python ----------
print index, ')'
# ---------- end python_39 ----------
analysisperiod = Ladybug_AnalysisPeriod(fromMonth=7, fromDay=30, fromHour=0, toMonth=8, toDay=5, toHour=23)  # -> readMe, analysisPeriod; plug-in component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
toggle_3 = BooleanToggle(True)
ins_10 = InsertItems(List=culln, Item=graft(python_39.out), Indices=subtraction_14, Wrap=True)
coordinates_of_building_footprints = Text(flatten(python_37.out))
insert_number_into_height_bg_column = Text(flatten(python_31.out))
insert_number_into_height_ag_column = Text(flatten(python_29.out))
create_a_shapely_polygon_from_the_coordi = Text(flatten(python_38.out))  # "# Create a Shapely polygon from the coordinates"
insert_polygon_into_the_geometry_column = Text(flatten(python_35.out))
insert_number_into_floors_ag_column = Text(flatten(python_30.out))
insert_number_into_floors_bg_column = Text(flatten(python_32.out))
insert_bldg_name = Text(flatten(python_33.out))
ins_11 = InsertItems(List=ins_10, Item=rep_4, Indices=0, Wrap=True)
runenergysimulation = Honeybee_RunEnergySimulation(
    epwFile=epw_stat.epwFile,
    analysisPeriod=analysisperiod.analysisPeriod,
    HBZones=flatten(mass2zone.HBZones),
    HBGenerators=generationsystem.HBGeneratorSystem,
    writeIdf=toggle_3,
    runEnergyPlus=toggle_3,
    idfFileName="Honeybeegeneration")  # -> report, idfFileAddress, resultFileAddress; plug-in component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
int_10 = Integer([0, 1, 2, 3, 4, 5, 6])
join_11 = TextJoin(Text=ins_11, Join=",")  # -> flatten(Result)
panel_27 = Panel(join_9)
panel_28 = Panel("""from dbfpy import dbf

## create empty DBF, set fields

path_occupancy=r'C:\UBG_to_CEA\baseline\inputs\building-properties\occupancy.dbf'

db = dbf.Dbf(path_occupancy, new=True)

db.addField(
    ("NAME", "C", 15),""")
panel_29 = Panel(join_3)
join_12 = TextJoin(Text=join_11, Join=", ")
panel_30 = Panel(join_12)
panel_31 = Panel(join_10)
panel_32 = Panel("""# coding=utf-8
\"\"\"
Create shapefile from Rhino
\"\"\"
from __future__ import division
import geopandas as gpd
from shapely.geometry import Polygon
from geopandas import GeoDataFrame as gdf


__author__ = "Zhongming Shi"
__copyright__ = "Copyright 2017, Architecture and Building Systems - ETH Zurich"
__credits__ = ["Zhongming Shi"]
__license__ = "MIT ??"
__version__ = "0.1"
__maintainer__ = "Daren Thomas"
__email__ = "cea@arch.ethz.ch"
__status__ = "Production"


dataframe_with_gis_info = gdf.from_file(r'F:\cea-reference-case\reference-case-zug\baseline\inputs\building-geometry/district.shp')



# Create an empty geopandas GeoDataFrame
district = gpd.GeoDataFrame()

# Create columns called 'geometry', 'height_ag', and 'height_bg" to the GeoDataFrame
district['NAME'] = None
district['FLOORS_AG'] = None
district['FLOORS_BG'] = None
district['HEIGHT_AG'] = None
district['HEIGHT_BG'] = None""")
panel_33 = Panel(insert_polygon_into_the_geometry_column)
panel_34 = Panel(insert_number_into_height_ag_column)
panel_35 = Panel(insert_number_into_height_bg_column)
panel_36 = Panel(insert_number_into_floors_ag_column)
panel_37 = Panel(insert_number_into_floors_bg_column)
panel_38 = Panel("""# Create an output path for the data to .shp
out_district=r"C:/UBG_to_CEA/baseline/inputs/building-geometry/district.shp"

# Write .shp
district.to_file(out_district, driver='ESRI Shapefile')""")
panel_39 = Panel(coordinates_of_building_footprints)
panel_40 = Panel(insert_bldg_name)
panel_41 = Panel(create_a_shapely_polygon_from_the_coordi)
panel_42 = Panel("""# Create an output path for the data to .shp

out_zone=r"C:/UBG_to_CEA/baseline/inputs/building-geometry/zone.shp"

# Write .shp
district.to_file(out_zone, driver='ESRI Shapefile')""")
panel_43 = Panel("""from dbfpy import dbf

## create empty DBF, set fields

path_age=r'C:\UBG_to_CEA\baseline\inputs\building-properties\age.dbf'

db = dbf.Dbf(path_age, new=True)

db.addField(
    ("NAME", "C", 15),
("BUILT", "C", 15),
("ROOF", "C", 15),
("WINDOWS", "C", 15),
("PARTITIONS", "C", 15),
("BASEMENT", "C", 15),
("HVAC", "C", 15),
("ENVELOPE", "C", 15)
)

## fill DBF with some records

for name, built, roof, windows, partitions, basement, hvac, envelope in (""")
panel_44 = Panel(join_2)
panel_45 = Panel("""):
    rec = db.newRecord()
    rec["NAME"] = name
    rec["BUILT"] = built
    rec["ROOF"] = roof
    rec["WINDOWS"] = windows
    rec["PARTITIONS"] = partitions
    rec["BASEMENT"] = basement
    rec["HVAC"] = hvac
    rec["ENVELOPE"] = envelope

    rec.store()
db.close()""")
panel_46 = Panel("""from dbfpy import dbf

## create empty DBF, set fields

path_supply=r'C:\UBG_to_CEA\baseline\inputs\building-properties\supply_systems.dbf'

db = dbf.Dbf(path_supply, new=True)

db.addField(
    ("NAME", "C", 15),
("TYPE_EL", "C", 15),
("TYPE_CS", "C", 15),
("TYPE_HS", "C", 15),
("TYPE_DHW", "C", 15)
)

## fill DBF with some records

for name, el, cs, hs, dhw in (""")
panel_47 = Panel("""):
    rec = db.newRecord()
    rec["NAME"] = name
    rec["TYPE_EL"] = el
    rec["TYPE_CS"] = cs
    rec["TYPE_HS"] = hs
    rec["TYPE_DHW"] = dhw

    rec.store()
db.close()""")
panel_48 = Panel(join_5)
panel_49 = Panel("""from dbfpy import dbf

## create empty DBF, set fields

path_architecture=r'C:\UBG_to_CEA\baseline\inputs\building-properties\architecture.dbf'

db = dbf.Dbf(path_architecture, new=True)

db.addField(
    ("NAME", "C", 15),
("WIN_WALL", "C", 15),
("TYPE_SHADE", "C", 15),
("OCC_M2P", "C", 15),
("N50", "C", 15),
("TYPE_ROOF", "C", 15),
("TYPE_WALL", "C", 15),
("TYPE_WIN", "C", 15),
("TH_MASS", "C", 15),
("ES", "C", 15),
("HS", "C", 15)
)

## fill DBF with some records

for name, win_wall, type_shade, occ_m2p, n50, type_roof, type_wall, type_win, th_mass, es, hs in (""")
panel_50 = Panel(join_6)
panel_51 = Panel("""):
    rec = db.newRecord()
    rec["NAME"] = name    
    rec["WIN_WALL"] = win_wall
    rec["TYPE_SHADE"] = type_shade
    rec["OCC_M2P"] = occ_m2p
    rec["N50"] = n50
    rec["TYPE_ROOF"] = type_roof
    rec["TYPE_WALL"] = type_wall
    rec["TYPE_WIN"] = type_win
    rec["TH_MASS"] = th_mass
    rec["ES"] = es
    rec["HS"] = hs

    rec.store()
db.close()""")
hourly_res = Number(division_9)
hourly_com = Number(division_11)
hourly_off = Number(division_10)
addition_3 = Addition(A=hourly_res, B=hourly_com, C=hourly_off)
readep_analyse_generation_system_results = Honeybee_Read_generation_system_results(resultFileAddress=runenergysimulation.resultFileAddress, idfFileAddress=runenergysimulation.idfFileAddress)  # -> Readme, totalelectdemand, netpurchasedelect, generatorproducedenergy, financialdata; plug-in component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
cull_i = CullIndex(List=readep_analyse_generation_system_results.generatorproducedenergy, Indices=int_10, Wrap=True)
hourly_demand = Number(addition_3)
hourly_pve = Number(cull_i)
panel_52 = Panel(hourly_pve)
merge_2 = Merge(
    Data1=panel_32,
    Data2=panel_39,
    Data3=panel_41,
    Data4=panel_40,
    Data5=panel_33,
    Data6=panel_34,
    Data7=panel_35,
    Data8=panel_36,
    Data9=panel_37,
    Data10=panel_42)
merge_3 = Merge(
    Data1=panel_32,
    Data2=panel_39,
    Data3=panel_41,
    Data4=panel_40,
    Data5=panel_33,
    Data6=panel_34,
    Data7=panel_35,
    Data8=panel_36,
    Data9=panel_37,
    Data10=panel_38)
lng_4 = ListLength(List=readep_analyse_generation_system_results.generatorproducedenergy)
subtraction_15 = Subtraction(A=hourly_pve, B=hourly_demand)
merge_4 = Merge(Data1=panel_28, Data2=panel_29, Data3=panel_27, Data4=panel_30, Data5=panel_31)
merge_5 = Merge(Data1=panel_43, Data2=panel_44, Data3=panel_45)
merge_6 = Merge(Data1=panel_46, Data2=panel_48, Data3=panel_47)
panel_53 = Panel(readep_analyse_generation_system_results.generatorproducedenergy)
merge_7 = Merge(Data1=panel_49, Data2=panel_50, Data3=panel_51)
subtraction_16 = Subtraction(A=lng_4, B=7)
abs = Absolute(Value=subtraction_15)
join_13 = TextJoin(Text=merge_3)
int_11 = Integer(["7", subtraction_16])
join_14 = TextJoin(Text=merge_4)
sort_3 = SortList(Keys=abs)  # -> Keys, ValuesA
join_15 = TextJoin(Text=merge_5)
join_16 = TextJoin(Text=merge_6)
join_17 = TextJoin(Text=merge_7)
join_18 = TextJoin(Text=merge_2)
panel_54 = Panel(join_13)
partition_4 = PartitionList(List=readep_analyse_generation_system_results.generatorproducedenergy, Size=int_11)
panel_55 = Panel(join_14)
rev_3 = ReverseList(List=sort_3.Keys)
item_15 = ListItem(List=rev_3, Index=0, Wrap=True)
panel_56 = Panel(join_15)
ma_7 = MassAddition(Input=partition_4)  # -> flatten(Result), PartialResults
panel_57 = Panel(join_16)
panel_58 = Panel(join_17)
clean_2 = CleanTree(RemoveNulls=True, RemoveInvalid=True, RemoveEmpty=False, Tree=ma_7.Result)
cull_5 = CullPattern(List=item_15, CullPattern=and)
panel_59 = Panel(clean_2)
cull_6 = CullPattern(List=clean_2, CullPattern=and)
totoal_demand = Number(total_electricity_demand)
pve = Number(cull_6)
cea_demand = CEADemand()  # -> data, result; inputs run: Boolean
# ---------- cea_demand: Python ----------
"""
Run the City Energy Analyst demand tool for a given scenario folder
and weather file and output the 
"""

import subprocess
import os

DEFAULT_COLUMN = 'QHf_MWhyr'

def get_python_exe():
    """Return the path to the python interpreter that was used to install CEA"""
    try:
        with open(os.path.expanduser('~/cea_python.pth'), 'r') as f:
            python_exe = f.read().strip()
            return python_exe
    except:
        raise AssertionError("Could not find 'cea_python.pth' in home directory.")

def get_environment():
    """Return the system environment to use for the execution - this is based on 
    the location of the python interpreter in ``get_python_exe``"""
    root_dir = os.path.dirname(get_python_exe())
    scripts_dir = os.path.join(root_dir, 'Scripts')
    os.environ['PATH'] = ';'.join((root_dir, scripts_dir, os.environ['PATH']))
    return {k: v for k, v in os.environ.items()}

def read_csv(csv_file):
    """emulate csv.DictReader for very simple csv files (no quotes, sep = ',')"""
    with open(csv_file, 'r') as f:
        content = f.readlines()
    header = content[0].split(',')
    data = content[1:]
    for row in data:
        yield {c: v for c, v in zip(header, row.split(','))}

def run_demand(scenario_path, epw_path, column='QHf_MWhyr'):
    """Run the CLI in a subprocess without showing windows"""
    startupinfo = subprocess.STARTUPINFO()
    # startupinfo.dwFlags |= subprocess.STARTF_USESHOWWINDOW
    
    command = [get_python_exe(), '-u', '-m', 'cea.cli', 
        '--scenario', scenario_path, 'demand', '--weather', epw_path]
    print(command)
    process = subprocess.Popen(command, startupinfo=startupinfo, 
        stdout=subprocess.PIPE, stderr=subprocess.PIPE,
        env=get_environment())
    while True:
        next_line = process.stdout.readline()
        if next_line == '' and process.poll() is not None:
            break
        print(next_line.rstrip())
    stdout, stderr = process.communicate()
    print(stdout)
    print(stderr)
        
    result = []
    total_demand_csv = os.path.join(scenario_path, 'outputs', 'data', 'demand',
        'Total_demand.csv')    
    reader = read_csv(total_demand_csv)   
    for row in reader:
        if not column in row.keys():
            column = DEFAULT_COLUMN        
        result.append((row['Name'], float(row[column])))
    return result

if run:
    data = run_demand(scenario_path, epw_path, column)
else:
    data = None
# ---------- end cea_demand ----------
occupancy_to_py = PythonScript(occupancy=panel_55)  # -> out, a
# ---------- occupancy_to_py: Python ----------
# coding=utf-8
"""
Create external .py to create occupancy.dbf
"""

import os

__author__ = "Zhongming Shi"
__copyright__ = "Copyright 2017, Architecture and Building Systems - ETH Zurich"
__credits__ = ["Zhongming Shi"]
__license__ = "MIT ??"
__version__ = "0.1"
__maintainer__ = "Daren Thomas"
__email__ = "cea@arch.ethz.ch"
__status__ = "Production"


string_output_occupancy = occupancy
open('C:/UBG_to_CEA/baseline/inputs/temporary/occupancy_dbf.py', 'w').close()
with open('C:/UBG_to_CEA/baseline/inputs/temporary/occupancy_dbf.py', 'a') as f:
    f.write(string_output_occupancy)
# ---------- end occupancy_to_py ----------
zone = PythonScript(shp=join_18)  # -> out, a
# ---------- zone: Python ----------
# coding=utf-8
"""
Create external .py to create .shp
"""

import os

__author__ = "Zhongming Shi"
__copyright__ = "Copyright 2017, Architecture and Building Systems - ETH Zurich"
__credits__ = ["Zhongming Shi"]
__license__ = "MIT ??"
__version__ = "0.1"
__maintainer__ = "Daren Thomas"
__email__ = "cea@arch.ethz.ch"
__status__ = "Production"


string_output_zone = shp
open('C:/UBG_to_CEA/baseline/inputs/temporary/zone_shp.py', 'w').close()
with open('C:/UBG_to_CEA/baseline/inputs/temporary/zone_shp.py', 'a') as f:
    f.write(string_output_zone)
# ---------- end zone ----------
district = PythonScript(shp=panel_54)  # -> out, a
# ---------- district: Python ----------
# coding=utf-8
"""
Create external .py to create .shp
"""

import os

__author__ = "Zhongming Shi"
__copyright__ = "Copyright 2017, Architecture and Building Systems - ETH Zurich"
__credits__ = ["Zhongming Shi"]
__license__ = "MIT ??"
__version__ = "0.1"
__maintainer__ = "Daren Thomas"
__email__ = "cea@arch.ethz.ch"
__status__ = "Production"


string_output_district = shp
open('C:/UBG_to_CEA/baseline/inputs/temporary/district_shp.py', 'w').close()
with open('C:/UBG_to_CEA/baseline/inputs/temporary/district_shp.py', 'a') as f:
    f.write(string_output_district)
# ---------- end district ----------
# # coding=utf-8
# """
# Create shapefile from Rhino
# """
# 
# import geopandas as gpd
# from shapely.geometry import Polygon
# from geopandas import GeoDataFrame as gdf
# 
# 
# __author__ = "Zhongming Shi"
# __copyright__ = "Copyright 2017, Architecture and Building Systems - ETH Zurich"
# __credits__ = ["Zhongming Shi"]
# __license__ = "MIT ??"
# __version__ = "0.1"
# __maintainer__ = "Daren Thomas"
# __email__ = "cea@arch.ethz.ch"
# __status__ = "Production"
# 
# 
# dataframe_with_gis_info = gdf.from_file(r'F:\cea-reference-case\reference-case-zug\baseline\inputs\building-geometry/district.shp')
# 
# #print dataframe_with_gis_info
# 
# 
# # Create an empty geopandas GeoDataFrame
# district = gpd.GeoDataFrame()
# 
# # Create columns called 'geometry', 'height_ag', and 'height_bg" to the GeoDataFrame
# district['NAME'] = None
# district['FLOORS_AG'] = None
# district['FLOORS_BG'] = None
# district['HEIGHT_AG'] = None
# district['HEIGHT_BG'] = None
# 
# # Coordinates of the building footprints
# 
# Coordinate_0 = [ (-90.3145561862,-195.926410910), (-114.255966219,-261.704894365), (-174.664777555,-239.717885151), (-150.723367522,-173.939401696) ]
# 
# # Create a Shapely polygon from the coordinate-tuple list
# 
# Poly_0 = Polygon( Coordinate_0 )
# 
# # Insert the name into 'NAME' -column at index 0
# district.loc[ 0 , 'NAME' ] = 'Bldg_0'
# 
# # Insert the polygon into 'geometry' -column at index 0
# district.loc[ 0 , 'geometry' ] = Poly_0
# 
# # Insert number into 'floors_ag' -column at index 0
# district.loc[ 0 , 'FLOORS_AG' ] = '11.0'
# 
# # Insert number into 'floors_bg' -column at index 0
# district.loc[ 0 , 'FLOORS_BG' ] = '0.0'
# 
# # Insert number into 'height_ag' -column at index 0
# district.loc[ 0 , 'HEIGHT_AG' ] = '33.0'
# 
# # Insert number into 'height_bg' -column at index 0
# 
# district.loc[ 0 , 'HEIGHT_BG' ] = '0.0'
# 
# print district
# 
# # Create an output path for the data to zone.shp
# out_district=r"C:/UBG_to_CEA/baseline/inputs/building-geometry/district.shp"
# 
# # Write district.shp
# district.to_file(out_district, driver='ESRI Shapefile')
create_folder_tree = PythonScript()  # -> out, a
# ---------- create_folder_tree: Python ----------
# coding=utf-8
"""
Create scenario folders in Grasshopper
"""

__author__ = "Zhongming Shi"
__copyright__ = "Copyright 2017, Architecture and Building Systems - ETH Zurich"
__credits__ = ["Zhongming Shi"]
__license__ = "MIT ??"
__version__ = "0.1"
__maintainer__ = "Daren Thomas"
__email__ = "cea@arch.ethz.ch"
__status__ = "Production"


# Create scenario folder tree.
# If exists, delete all the files and maintain the folder tree.
# If not, make one folder tree.

import os

# make folder "UBG_to_CEA"
dir = "C:/UBG_to_CEA/"
dir_geometry = "C:/UBG_to_CEA/baseline/inputs/building-geometry"
dir_metering = "C:/UBG_to_CEA/baseline/inputs/building-metering"
dir_properties = "C:/UBG_to_CEA/baseline/inputs/building-properties"
dir_topography = "C:/UBG_to_CEA/baseline/inputs/topography"
dir_temporary = "C:/UBG_to_CEA/baseline/inputs/temporary"

# make the scenario folder tree
if not os.path.exists(dir): # if the directory does not exist
    os.makedirs(dir) # make the directory
    os.makedirs(dir_geometry)
    os.makedirs(dir_metering)
    os.makedirs(dir_properties)
    os.makedirs(dir_topography)
    os.makedirs(dir_temporary)

else: # the directory exists
    pass
# ---------- end create_folder_tree ----------
age_to_py = PythonScript(age=panel_56)  # -> out, a
# ---------- age_to_py: Python ----------
# coding=utf-8
"""
Create external .py to create age.dbf
"""

import os

__author__ = "Zhongming Shi"
__copyright__ = "Copyright 2017, Architecture and Building Systems - ETH Zurich"
__credits__ = ["Zhongming Shi"]
__license__ = "MIT ??"
__version__ = "0.1"
__maintainer__ = "Daren Thomas"
__email__ = "cea@arch.ethz.ch"
__status__ = "Production"


string_output_age = age
open('C:/UBG_to_CEA/baseline/inputs/temporary/age_dbf.py', 'w').close()
with open('C:/UBG_to_CEA/baseline/inputs/temporary/age_dbf.py', 'a') as f:
    f.write(string_output_age)
# ---------- end age_to_py ----------
division_15 = Division(A=pve, B=totoal_demand)
supply_systems_to_py = PythonScript(supply=panel_57)  # -> out, a
# ---------- supply_systems_to_py: Python ----------
# coding=utf-8
"""
Create external .py to create age.dbf
"""

import os

__author__ = "Zhongming Shi"
__copyright__ = "Copyright 2017, Architecture and Building Systems - ETH Zurich"
__credits__ = ["Zhongming Shi"]
__license__ = "MIT ??"
__version__ = "0.1"
__maintainer__ = "Daren Thomas"
__email__ = "cea@arch.ethz.ch"
__status__ = "Production"


string_output_supply = supply
open('C:/UBG_to_CEA/baseline/inputs/temporary/supply_dbf.py', 'w').close()
with open('C:/UBG_to_CEA/baseline/inputs/temporary/supply_dbf.py', 'a') as f:
    f.write(string_output_supply)
# ---------- end supply_systems_to_py ----------
supply_systems_to_py_2 = PythonScript(architecture=panel_58)  # -> out, a
# ---------- supply_systems_to_py_2: Python ----------
# coding=utf-8
"""
Create external .py to create age.dbf
"""

import os

__author__ = "Zhongming Shi"
__copyright__ = "Copyright 2017, Architecture and Building Systems - ETH Zurich"
__credits__ = ["Zhongming Shi"]
__license__ = "MIT ??"
__version__ = "0.1"
__maintainer__ = "Daren Thomas"
__email__ = "cea@arch.ethz.ch"
__status__ = "Production"


string_output_architecture = architecture
open('C:/UBG_to_CEA/baseline/inputs/temporary/architecture_dbf.py', 'w').close()
with open('C:/UBG_to_CEA/baseline/inputs/temporary/architecture_dbf.py', 'a') as f:
    f.write(string_output_architecture)
# ---------- end supply_systems_to_py_2 ----------
res_4 = Number(division_15)
gfa_tested_2 = Number(gfa_tested)
far_tested_2 = Number(far_tested)
pve_2 = Number(pve)
demand_on_grid_kwh = Number(cull_5)
division_16 = Division(A=gfa_tested_2, B=10000000)
division_17 = Division(A=demand_on_grid_kwh, B=100000)
neg_3 = Negative(Value=res_4)
neg_4 = Negative(Value=division_16)
cull_7 = CullPattern(List=d, CullPattern=and)
cull_8 = CullPattern(List=w, CullPattern=and)
cull_9 = CullPattern(List=res_3, CullPattern=and)
cull_10 = CullPattern(List=com_3, CullPattern=and)
cull_11 = CullPattern(List=r_2, CullPattern=and)
cull_12 = CullPattern(List=off_2, CullPattern=and)
gfa_10000k_m2 = Number(neg_4)
demand_on_grid_100000kwh = Number(division_17)
res_5 = Number(neg_3)
panel_60 = Panel(gfa_10000k_m2)
panel_61 = Panel(res_5)
panel_62 = Panel(demand_on_grid_100000kwh)
rec = DataRecorder(cull_11, DataLimit=-10, RecordData=True)
rec_2 = DataRecorder(cull_12, DataLimit=-10, RecordData=True)
rec_3 = DataRecorder(cull_7, DataLimit=-10, RecordData=True)
rec_4 = DataRecorder(cull_8, DataLimit=-10, RecordData=True)
rec_5 = DataRecorder(cull_9, DataLimit=-10, RecordData=True)
rec_6 = DataRecorder(res_4, DataLimit=-10, RecordData=True)
rec_7 = DataRecorder(gfa_tested_2, DataLimit=-10, RecordData=True)
rec_8 = DataRecorder(cull_10, DataLimit=-10, RecordData=True)
rec_9 = DataRecorder(demand_on_grid_kwh, DataLimit=-10, RecordData=True)
rec_10 = DataRecorder(pve_2, DataLimit=-10, RecordData=True)
rec_11 = DataRecorder(far_tested_2, DataLimit=-10, RecordData=True)
panel_63 = Panel(rec)
panel_64 = Panel(rec_2)
panel_65 = Panel(rec_8)
panel_66 = Panel(rec_3)
panel_67 = Panel(rec_4)
panel_68 = Panel(rec_5)
octopus = Octopus(
    OctopusData_gene=[number_slider_2, number_slider_3, number_slider, number_slider_4, number_slider_5, number_slider_6],
    OctopusData_obj=[res_5, gfa_10000k_m2, demand_on_grid_100000kwh])
panel_69 = Panel(rec_6)
panel_70 = Panel(rec_7)
panel_71 = Panel(rec_11)
panel_72 = Panel(rec_10)
panel_73 = Panel(rec_9)
panel_74 = Panel([panel_66, panel_67, panel_63, panel_68, panel_65, panel_64, panel_69, panel_70, panel_71, panel_72, panel_73])
data = Data(flatten(panel_74))
panel_75 = Panel(data)
