# Grasshopper definition urban_design.gh (Grasshopper 0.9.76)
# plug-ins: Python Interpreter

bldg_perimeter_factor = Slider(0.31, range=0..1)
block_length = Slider(80, range=60..120)
site_coverage = Slider(0.2, range=0..1)
floor_area_ratio = Slider(8.7, range=0..10)
floor_height = Slider(3, range=0..10)
block_length_2 = Number(block_length)
area_of_site = Square(Value=block_length_2)
area_of_bldg_footprint = Multiplication(A=area_of_site, B=site_coverage)
sqrt = SquareRoot(Value=area_of_bldg_footprint)
dom = ConstructDomain(DomainStart=sqrt, DomainEnd=block_length_2)
remap = RemapNumbers(Value=bldg_perimeter_factor, Source=Domain(0, 1), Target=dom)  # -> Mapped, Clipped
area_of_bldg_footprint_2 = Number(area_of_bldg_footprint)
floor_area_ratio_2 = Number(floor_area_ratio)
site_coverage_2 = Number(site_coverage)
bldg_footprint_length = Number(remap.Mapped)
sqr = Square(Value=bldg_footprint_length)
subtraction = Subtraction(A=sqr, B=area_of_bldg_footprint_2)
area_of_patio = Number(subtraction)
rectangle = Rectangle(Plane=PlaneXY(0, 0, 0), XSize=block_length_2, YSize=block_length_2, Radius=0)  # -> Rectangle, Length
sqrt_2 = SquareRoot(Value=area_of_patio)
block_boundary = Curve(rectangle.Rectangle)
length_of_patio = Number(sqrt_2)
subtraction_2 = Subtraction(A=block_length_2, B=length_of_patio)
subtraction_3 = Subtraction(A=block_length_2, B=bldg_footprint_length)
subtraction_4 = Subtraction(A=bldg_footprint_length, B=length_of_patio)
division = Division(A=subtraction_2, B=-2)
division_2 = Division(A=subtraction_3, B=-2)
division_3 = Division(A=subtraction_4, B=2)
neg = Negative(Value=division_3)
offset = Offset(Curve=block_boundary, Distance=division, Plane=PlaneXY(0, 0, 0), Corners=1)
offset_2 = Offset(Curve=block_boundary, Distance=division_2, Plane=PlaneXY(0, 0, 0), Corners=1)
original_site = Surface(block_boundary)
boundary = BoundarySurfaces(Edges=offset)
boundary_2 = BoundarySurfaces(Edges=offset_2)
sdiff = SolidDifference(BrepsA=boundary, BrepsB=boundary_2)
bldg_footprint = Surface(sdiff)
flip = Flip(Surface=bldg_footprint)  # -> Surface, Result
sdiff_2 = SolidDifference(BrepsA=original_site, BrepsB=flip.Surface)
multiplication = Multiplication(A=area_of_site, B=floor_area_ratio)
gross_floor_area = Number(multiplication)
division_4 = Division(A=gross_floor_area, B=area_of_bldg_footprint_2)
round = Round(Number=division_4)  # -> Nearest, Floor, Ceiling
of_floors = Integer(round.Floor)
multiplication_2 = Multiplication(A=floor_height, B=of_floors)
bldg_height = Number(multiplication_2)
Z = UnitZ(Factor=bldg_height)
move = Move(Geometry=bldg_footprint, Motion=Z)  # -> Geometry, Transform
extr = Extrude(Base=offset_2, Direction=Z)
extr_2 = Extrude(Base=offset, Direction=Z)
debrep = DeconstructBrep(Brep=extr)  # -> Faces, Edges, Vertices
debrep_2 = DeconstructBrep(Brep=extr_2)  # -> Faces, Edges, Vertices
roof = Surface(move.Geometry)
open_space = Surface(sdiff_2)
facade_exterior = Brep(debrep.Faces)
facade_interior = Surface(debrep_2.Faces)
flip_2 = Flip(Surface=roof)  # -> Surface, Result
flip_3 = Flip(Surface=facade_exterior)  # -> Surface, Result
all_srf_for_pv = Brep([open_space, flip_2.Surface, flip_3.Surface, facade_interior])
panel = Panel("https://www.energyplus.net/weather-download/southwest_pacific_wmo_region_5/SGP//SGP_Singapore.486980_IWEC/all")

# ---- group: extract surface from polysurface
brep = Brep(flatten(all_srf_for_pv))
debrep_3 = DeconstructBrep(Brep=brep)  # -> Faces, Edges, Vertices
item = ListItem(List=debrep_3.Faces, Index=0, Wrap=True)

# ----
ladybug = Ladybug_Ladybug(defaultFolder="c:/ladybug")  # -> Vviiiiiiiiiizzz; plug-in component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
dctoacderatefactor = Ladybug_DCToACDerateFactor(
    annualShading="0",
    age=0,
    snow=0,
    wiring=2,
    soiling=2,
    mismatch=2,
    availability=3,
    connections=0.5,
    nameplateRating=1,
    lightInducedDegradation=1.5)  # -> readMe, totalLosses, DCtoACderateFactor; plug-in component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
epw_stat = Ladybug_OpenEPWAndSTATWeatherFiles(weatherFileURL=panel)  # -> epwFile, statFile; plug-in component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
panel_2 = Panel(dctoacderatefactor.DCtoACderateFactor)

# ---- group: PVsurface normal direction check
evalsrf = EvaluateSurface(Point="0.5,0.5")  # -> Point, Normal, Frame
vdis = VectorDisplay(Anchor=evalsrf.Point, Vector=expr("x*10", evalsrf.Normal))

# ----
photovoltaicssurface = Ladybug_PhotovoltaicsSurface(
    epwFile=epw_stat.epwFile,
    PVsurface=graft(item),
    PVsurfacePercent=100,
    DCtoACderateFactor=dctoacderatefactor.DCtoACderateFactor,
    PVmoduleSettings=[1, 15, -0.5, 90],
    north=0,
    runIt=Toggle(True))  # -> readMe, port, ACenergyPerHour, ACenergyPerYear, averageDailyACenergyPerYear, port_2, DCenergyPerHour, totalRadiationPerHour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; plug-in component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
panel_3 = Panel(photovoltaicssurface.ACenergyPerYear)
ma = MassAddition(Input=flatten(panel_3))  # -> Result, PartialResults
panel_4 = Panel(ma.Result)
galapagos = Galapagos(fitness=ma, gene=[floor_area_ratio, site_coverage, bldg_perimeter_factor])
