# Grasshopper definition UBG_CityGML_2 patterns.gh (Grasshopper 0.9.76)
# plug-ins: Python Interpreter

window_to_wall_ratio_interior = Slider(0.1, range=0..1)
street_width = Slider(24, range=12..50)
bldg_perimeter_factor = Slider(0.43, range=0..1)
# Input
# of design parameters
block_length = Slider(80, range=60..120)
site_coverage = Slider(0.71, range=0.1..1)
window_to_wall_ratio_exterior = Slider(0.3, range=0..1)
floor_area_ratio = Slider(7.2, range=1..10)
floor_height = Slider(3, range=0..10)

# ----
# Urban design scenario
# generation engine
block_length_2 = Number(block_length)
area_of_site = Square(Value=block_length_2)
area_of_bldg_footprint = Multiplication(A=area_of_site, B=site_coverage)
sqrt = SquareRoot(Value=area_of_bldg_footprint)
dom = ConstructDomain(DomainStart=sqrt, DomainEnd=block_length_2)
remap = RemapNumbers(Value=bldg_perimeter_factor, Source=Domain(0, 1), Target=dom)  # -> Mapped, Clipped
area_of_bldg_footprint_2 = Number(area_of_bldg_footprint)
floor_area_ratio_2 = Number(floor_area_ratio)
site_coverage_2 = Number(site_coverage)
bldg_footprint_length = Number(remap.Mapped)
window_to_wall_ratio_exterior_2 = Number(window_to_wall_ratio_exterior)
window_to_wall_ratio_interior_2 = Number(window_to_wall_ratio_interior)
floor_height_2 = Number(floor_height)
sqr = Square(Value=bldg_footprint_length)
subtraction = Subtraction(A=sqr, B=area_of_bldg_footprint_2)
area_of_patio = Number(subtraction)
rectangle = Rectangle(Plane=PlaneXY(0, 0, 0), XSize=block_length_2, YSize=block_length_2, Radius=0)  # -> Rectangle, Length
round = Round(Number=area_of_patio)  # -> Nearest, Floor, Ceiling
block_boundary = Curve(rectangle.Rectangle)
sqrt_2 = SquareRoot(Value=round.Nearest)
length_of_patio = Number(sqrt_2)
subtraction_2 = Subtraction(A=block_length_2, B=length_of_patio)
subtraction_3 = Subtraction(A=block_length_2, B=bldg_footprint_length)
division = Division(A=subtraction_2, B=-2)
division_2 = Division(A=subtraction_3, B=-2)
offset = Offset(Curve=block_boundary, Distance=division, Plane=PlaneXY(0, 0, 0), Corners=1)
offset_2 = Offset(Curve=block_boundary, Distance=division_2, Plane=PlaneXY(0, 0, 0), Corners=1)
boundary = BoundarySurfaces(Edges=offset)
rdiff = RegionDifference(CurvesA=block_boundary, CurvesB=offset_2)
boundary_2 = BoundarySurfaces(Edges=[offset, offset_2])
boundary_3 = BoundarySurfaces(Edges=rdiff)
bldg_footprint = Surface(boundary_2)
open_space_outter = Surface(boundary_3)
open_space_interior = Surface(boundary)
exterior_line = Curve(offset_2)
interior_line = Curve(offset)
Z = UnitZ(Factor=floor_height_2)
multiplication = Multiplication(A=area_of_site, B=floor_area_ratio)
gross_floor_area = Number(multiplication)
extr = Extrude(Base=exterior_line, Direction=Z)
extr_2 = Extrude(Base=interior_line, Direction=Z)
debrep = DeconstructBrep(Brep=extr)  # -> Faces, Edges, Vertices
debrep_2 = DeconstructBrep(Brep=extr_2)  # -> Faces, Edges, Vertices
division_3 = Division(A=gross_floor_area, B=area_of_bldg_footprint_2)
flip = Flip(Surface=debrep.Faces)  # -> Surface, Result
round_2 = Round(Number=division_3)  # -> Nearest, Floor, Ceiling
srf_of_exterior_envelop = Surface(flip.Surface)
srf_of_interior_envelop = Surface(debrep_2.Faces)
of_floors = Integer(round_2.Floor)
sqrt_3 = SquareRoot(Value=window_to_wall_ratio_exterior_2)
sqrt_4 = SquareRoot(Value=window_to_wall_ratio_interior_2)
multiplication_2 = Multiplication(A=floor_height_2, B=of_floors)
area = Area(Geometry=srf_of_exterior_envelop)  # -> Area, Centroid
area_2 = Area(Geometry=srf_of_interior_envelop)  # -> Area, Centroid
bldg_height = Number(multiplication_2)
scale = Scale(Geometry=srf_of_interior_envelop, Center=area_2.Centroid, Factor=sqrt_4)  # -> Geometry, Transform
scale_2 = Scale(Geometry=flip.Surface, Center=area.Centroid, Factor=sqrt_3)  # -> Geometry, Transform
Z_2 = UnitZ(Factor=bldg_height)
series = Series(Start=0, Step=1, Count=of_floors)
srf_of_exterior_glazing = Surface(scale_2.Geometry)
srf_of_interior_glazing = Surface(scale.Geometry)
multiplication_3 = Multiplication(A=floor_height_2, B=series)
extr_3 = Extrude(Base=offset_2, Direction=Z_2)
move = Move(Geometry=bldg_footprint, Motion=Z_2)  # -> Geometry, Transform
extr_4 = Extrude(Base=offset, Direction=Z_2)
debrep_3 = DeconstructBrep(Brep=extr_3)  # -> Faces, Edges, Vertices
debrep_4 = DeconstructBrep(Brep=extr_4)  # -> Faces, Edges, Vertices
Z_3 = UnitZ(Factor=multiplication_3)
Z_4 = UnitZ(Factor=multiplication_3)
Z_5 = UnitZ(Factor=multiplication_3)
Z_6 = UnitZ(Factor=multiplication_3)
flip_2 = Flip(Surface=debrep_3.Faces)  # -> Surface, Result
move_2 = Move(Geometry=graft(srf_of_exterior_envelop), Motion=Z_3)  # -> Geometry, Transform
move_3 = Move(Geometry=graft(srf_of_interior_glazing), Motion=Z_4)  # -> Geometry, Transform
move_4 = Move(Geometry=graft(srf_of_interior_envelop), Motion=Z_5)  # -> Geometry, Transform
move_5 = Move(Geometry=graft(srf_of_exterior_glazing), Motion=Z_6)  # -> Geometry, Transform
panel = Panel(multiplication_3)
facade_exterior = Brep(flip_2.Surface)
open_space = Surface(flatten([open_space_outter, open_space_interior]))
facade_interior = Surface(debrep_4.Faces)
srf_of_exterior_envelop_2 = Surface(move_2.Geometry)
roof = Surface(move.Geometry)
srf_of_exterior_glazing_2 = Surface(move_5.Geometry)
srf_of_interior_envelop_2 = Surface(move_4.Geometry)
srf_of_interior_glazing_2 = Surface(move_3.Geometry)
bldg_footprint_2 = Surface(boundary_2)
roof_2 = Surface(move.Geometry)
bldg_height_2 = Number(multiplication_2)
all_srf_for_pv = Brep(flatten([open_space, facade_exterior, facade_interior, roof]))
panel_2 = Panel(area.Area)
srf = Surface(flatten([srf_of_exterior_glazing_2, srf_of_interior_glazing_2]))
srf_2 = Surface(flatten([srf_of_exterior_envelop_2, srf_of_interior_envelop_2]))
lng = ListLength(List=srf)
lng_2 = ListLength(List=srf_2)
number_slider = Slider(2, range=0..10)
number_slider_2 = Slider(2, range=0..10)
addition = Addition(A=block_length, B=street_width)
addition_2 = Addition(A=block_length, B=street_width)
addition_3 = Addition(A=block_length, B=street_width)
addition_4 = Addition(A=block_length, B=street_width)
addition_5 = Addition(A=block_length, B=street_width)
addition_6 = Addition(A=block_length, B=street_width)
rectangle_2 = Rectangle(Plane=PlaneXY(0, 0, 0), XSize=addition, YSize=addition, Radius=0)  # -> Rectangle, Length
rectangle_3 = Rectangle(Plane=PlaneXY(0, 0, 0), XSize=addition_2, YSize=addition_2, Radius=0)  # -> Rectangle, Length
rectangle_4 = Rectangle(Plane=PlaneXY(0, 0, 0), XSize=addition_3, YSize=addition_3, Radius=0)  # -> Rectangle, Length
rectangle_5 = Rectangle(Plane=PlaneXY(0, 0, 0), XSize=addition_4, YSize=addition_4, Radius=0)  # -> Rectangle, Length
rectangle_6 = Rectangle(Plane=PlaneXY(0, 0, 0), XSize=addition_5, YSize=addition_5, Radius=0)  # -> Rectangle, Length
rectangle_7 = Rectangle(Plane=PlaneXY(0, 0, 0), XSize=addition_6, YSize=addition_6, Radius=0)  # -> Rectangle, Length
arrrec = RectangularArray(Geometry=srf_of_interior_glazing_2, Cell=rectangle_2.Rectangle, XCount=number_slider_2, YCount=number_slider)  # -> Geometry, Transform
arrrec_2 = RectangularArray(Geometry=roof_2, Cell=rectangle_3.Rectangle, XCount=number_slider_2, YCount=number_slider)  # -> Geometry, Transform
arrrec_3 = RectangularArray(Geometry=srf_of_exterior_envelop_2, Cell=rectangle_4.Rectangle, XCount=number_slider_2, YCount=number_slider)  # -> Geometry, Transform
arrrec_4 = RectangularArray(Geometry=srf_of_exterior_glazing_2, Cell=rectangle_5.Rectangle, XCount=number_slider_2, YCount=number_slider)  # -> Geometry, Transform
arrrec_5 = RectangularArray(Geometry=bldg_footprint_2, Cell=rectangle_6.Rectangle, XCount=number_slider_2, YCount=number_slider)  # -> Geometry, Transform
arrrec_6 = RectangularArray(Geometry=srf_of_interior_envelop_2, Cell=rectangle_7.Rectangle, XCount=number_slider_2, YCount=number_slider)  # -> Geometry, Transform
srf_of_exterior_envelop_3 = Surface(arrrec_3.Geometry)
srf_of_exterior_glazing_3 = Surface(arrrec_4.Geometry)
srf_of_interior_envelop_3 = Surface(arrrec_6.Geometry)
srf_of_interior_glazing_3 = Surface(arrrec.Geometry)
bldg_footprint_3 = Surface(arrrec_5.Geometry)
roof_3 = Surface(arrrec_2.Geometry)

# ----
# CityGML
# parser
all_bld_footprint_generated = Surface(graft(bldg_footprint_3))
panel_3 = Panel("Footprint")
all_bld_footprint_generated_2 = Surface(graft(bldg_footprint_3))
exterior_line_2 = Curve(offset_2)
interior_line_2 = Curve(offset)
panel_4 = Panel("Rooftop")
all_bld_rooftop_generated = Surface(graft(roof_3))
lng_3 = ListLength(List=flatten(all_bld_footprint_generated))
debrep_5 = DeconstructBrep(Brep=exterior_line_2)  # -> Faces, Edges, Vertices
of_bldg_generated = Integer(lng_3)
bbox = BoundingBox(Content=all_bld_footprint_generated, Plane=PlaneXY(0, 0, 0))  # -> Box, Box_2
edges = BrepEdges(Brep=all_bld_footprint_generated)  # -> Naked, Interior, NonManifold
area_3 = Area(Geometry=all_bld_footprint_generated_2)  # -> Area, Centroid
item = ListItem(List=debrep_5.Edges, Index=0, Wrap=True)
srf_3 = Surface(bbox.Box)
series_2 = Series(Start=1, Step=1, Count=of_bldg_generated)
bld_footprint = JoinCurves(Curves=edges.Naked, Preserve=False)
series_3 = Series(Start=1, Step=1, Count=lng_2)
series_4 = Series(Start=1, Step=1, Count=lng)
edges_2 = BrepEdges(Brep=srf_3)  # -> Naked, Interior, NonManifold
crv_cp = CurveClosestPoint(Point=area_3.Centroid, Curve=item)  # -> Point, Parameter, Distance
int = Integer(series_3)
int_2 = Integer(series_4)
neg = Negative(Value=crv_cp.Distance)
end = EndPoints(Curve=edges_2.Naked)  # -> Start, End
Z_7 = UnitZ(Factor=bldg_height_2)
footprint = Text("footprint_")
int_3 = Integer(series_2)
footprint_2 = Text("footprint_")
bldg = Text("bldg_")
building = Text("Building_")
facade = Text("Facade_")
roof_4 = Text("Roof_")
roof_5 = Text("Roof_")
window = Text("Window_")
offset_3 = Offset(Curve=item, Distance=neg, Plane=PlaneXY(0, 0, 0), Corners=1)
extr_5 = Extrude(Base=offset_3, Direction=Z_7)
all_interior_envelop_generated = Surface(graft(srf_of_interior_envelop_3))
all_interior_glazing_generated = Surface(graft(srf_of_interior_glazing_3))
all_exterior_envelop_generated = Surface(graft(srf_of_exterior_envelop_3))
all_exterior_glazing_generated = Surface(graft(srf_of_exterior_glazing_3))
item_2 = ListItem(List=end.Start, Index=0, Wrap=True)
item_3 = ListItem(List=end.Start, Index=2, Wrap=True)
panel_5 = Panel("Interior envelop")
panel_6 = Panel("Interior glazing")
panel_7 = Panel("Exterior envelop")
Z_8 = UnitZ(Factor=bldg_height_2)
panel_8 = Panel("Exterior glazing")
split = SplitBrep(Brep=all_bld_footprint_generated_2, Cutter=extr_5)
python = PythonScript(Building=building, Int=int_3)  # -> out, a
# ---------- python: Python ----------
print Building_,Int
# ---------- end python ----------
python_2 = PythonScript(footprint=footprint, Int=int_3, Int1="1")  # -> out, a
# ---------- python_2: Python ----------
print footprint_,Int,"_",Int1
# ---------- end python_2 ----------
split_2 = SplitBrep(Brep=all_bld_rooftop_generated, Cutter=extr_5)
python_3 = PythonScript(bldg=bldg, Int=int_3)  # -> out, a
# ---------- python_3: Python ----------
print bldg_,Int
# ---------- end python_3 ----------
python_4 = PythonScript(Window=window, Int=int_2)  # -> out, a
# ---------- python_4: Python ----------
print Window_,Int
# ---------- end python_4 ----------
python_5 = PythonScript(footprint=footprint_2, Int=int_3, Int1="2")  # -> out, a; same code as python_2
python_6 = PythonScript(Facade=facade, Int=int)  # -> out, a
# ---------- python_6: Python ----------
print Facade_,Int
# ---------- end python_6 ----------
python_7 = PythonScript(Roof=roof_4, Int=int_3, Int1="1")  # -> out, a
# ---------- python_7: Python ----------
print Roof_,Int,"_",Int1
# ---------- end python_7 ----------
python_8 = PythonScript(Roof=roof_5, Int=int_3, Int1="2")  # -> out, a; same code as python_7
move_6 = Move(Geometry=item_3, Motion=Z_8)  # -> Geometry, Transform
item_4 = ListItem(List=split, Index=0, Wrap=True)
item_5 = ListItem(List=split_2, Index=0, Wrap=True)
item_6 = ListItem(List=split, Index=1, Wrap=True)
item_7 = ListItem(List=split_2, Index=1, Wrap=True)
footprint_id = Text(python_2.out)
footprint_id_2 = Text(python_5.out)
building_id = Text(python.out)
bldg__id = Text(python_3.out)
window_id = Text(python_4.out)
facade_id = Text(python_6.out)
roof_id = Text(python_7.out)
roof_id_2 = Text(python_8.out)
pt_of_envelope_1 = Point(item_2)
pt_of_envelope_2 = Point(move_6.Geometry)
debrep_6 = DeconstructBrep(Brep=item_4)  # -> Faces, Edges, Vertices
debrep_7 = DeconstructBrep(Brep=item_6)  # -> Faces, Edges, Vertices
debrep_8 = DeconstructBrep(Brep=item_5)  # -> Faces, Edges, Vertices
debrep_9 = DeconstructBrep(Brep=item_7)  # -> Faces, Edges, Vertices
panel_9 = Panel(bld_footprint)
rep = ReplaceText(Text=footprint_id, Find=" ", RecursiveReplace=False)
rep_2 = ReplaceText(Text=bldg__id, Find=" ", RecursiveReplace=False)
rep_3 = ReplaceText(Text=building_id, Find=" ", RecursiveReplace=False)
rep_4 = ReplaceText(Text=footprint_id_2, Find=" ", RecursiveReplace=False)
rep_5 = ReplaceText(Text=facade_id, Find=" ", RecursiveReplace=False)
debrep_10 = DeconstructBrep(Brep=all_interior_envelop_generated)  # -> Faces, Edges, Vertices
rep_6 = ReplaceText(Text=window_id, Find=" ", RecursiveReplace=False)
rep_7 = ReplaceText(Text=roof_id, Find=" ", RecursiveReplace=False)
debrep_11 = DeconstructBrep(Brep=all_exterior_envelop_generated)  # -> Faces, Edges, Vertices
rep_8 = ReplaceText(Text=roof_id_2, Find=" ", RecursiveReplace=False)
debrep_12 = DeconstructBrep(Brep=all_exterior_glazing_generated)  # -> Faces, Edges, Vertices
debrep_13 = DeconstructBrep(Brep=all_interior_glazing_generated)  # -> Faces, Edges, Vertices
panel_10 = Panel(split)
lc = Deconstruct(Point=pt_of_envelope_1)  # -> XComponent, YComponent, ZComponent
uc = Deconstruct(Point=pt_of_envelope_2)  # -> XComponent, YComponent, ZComponent
join = JoinCurves(Curves=debrep_7.Edges, Preserve=False)
join_2 = JoinCurves(Curves=debrep_6.Edges, Preserve=False)
join_3 = JoinCurves(Curves=debrep_8.Edges, Preserve=False)
join_4 = JoinCurves(Curves=debrep_9.Edges, Preserve=False)
ucy = Number(uc.YComponent)
ucz = Number(uc.ZComponent)
lcy = Number(lc.YComponent)
lcz = Number(lc.ZComponent)
ucx = Number(uc.XComponent)
lcx = Number(lc.XComponent)
debrep_14 = DeconstructBrep(Brep=join)  # -> Faces, Edges, Vertices
debrep_15 = DeconstructBrep(Brep=join_2)  # -> Faces, Edges, Vertices
debrep_16 = DeconstructBrep(Brep=join_3)  # -> Faces, Edges, Vertices
debrep_17 = DeconstructBrep(Brep=join_4)  # -> Faces, Edges, Vertices
item_8 = ListItem(List=debrep_10.Vertices, Index=0, Wrap=True)
item_9 = ListItem(List=debrep_13.Vertices, Index=0, Wrap=True)
item_10 = ListItem(List=debrep_11.Vertices, Index=0, Wrap=True)
item_11 = ListItem(List=debrep_12.Vertices, Index=0, Wrap=True)
panel_11 = Panel([rep_7, rep_8])
lng_4 = ListLength(List=debrep_14.Vertices)
item_12 = ListItem(List=debrep_14.Vertices, Index=0, Wrap=True)
lng_5 = ListLength(List=debrep_15.Vertices)
item_13 = ListItem(List=debrep_15.Vertices, Index=0, Wrap=True)
lng_6 = ListLength(List=debrep_10.Vertices)
lng_7 = ListLength(List=debrep_13.Vertices)
lng_8 = ListLength(List=debrep_11.Vertices)
lng_9 = ListLength(List=debrep_12.Vertices)
lng_10 = ListLength(List=debrep_16.Vertices)
item_14 = ListItem(List=debrep_16.Vertices, Index=0, Wrap=True)
lng_11 = ListLength(List=debrep_17.Vertices)
item_15 = ListItem(List=debrep_17.Vertices, Index=0, Wrap=True)
panel_12 = Panel(join_2)
ins = InsertItems(List=debrep_14.Vertices, Item=item_12, Indices=lng_4, Wrap=True)
ins_2 = InsertItems(List=debrep_10.Vertices, Item=item_8, Indices=lng_6, Wrap=True)
ins_3 = InsertItems(List=debrep_13.Vertices, Item=item_9, Indices=lng_7, Wrap=True)
ins_4 = InsertItems(List=debrep_11.Vertices, Item=item_10, Indices=lng_8, Wrap=True)
ins_5 = InsertItems(List=debrep_12.Vertices, Item=item_11, Indices=lng_9, Wrap=True)
ins_6 = InsertItems(List=debrep_15.Vertices, Item=item_13, Indices=lng_5, Wrap=True)
ins_7 = InsertItems(List=debrep_16.Vertices, Item=item_14, Indices=lng_10, Wrap=True)
ins_8 = InsertItems(List=debrep_17.Vertices, Item=item_15, Indices=lng_11, Wrap=True)
pt_that_form_the_polygon_of_bldg_footpri = Point(ins)  # "Pt that form the polygon of bldg footprint"
pt_that_form_the_polygon_of_bldg_footpri_2 = Point(ins_6)  # "Pt that form the polygon of bldg footprint"
pt_that_form_the_interior_envelop = Point(ins_2)
pt_that_form_the_interior_glazing = Point(ins_3)
pt_that_form_the_exterior_envelop = Point(ins_4)
pt_that_form_the_exterior_glazing = Point(ins_5)
pt_that_form_the_polygon_of_bldg_rooftop = Point(ins_7)
pt_that_form_the_polygon_of_bldg_rooftop_2 = Point(ins_8)
pdecon = Deconstruct(Point=pt_that_form_the_polygon_of_bldg_footpri_2)  # -> graft(XComponent), graft(YComponent), graft(ZComponent)
pdecon_2 = Deconstruct(Point=pt_that_form_the_interior_envelop)  # -> graft(XComponent), graft(YComponent), graft(ZComponent)
pdecon_3 = Deconstruct(Point=pt_that_form_the_interior_glazing)  # -> graft(XComponent), graft(YComponent), graft(ZComponent)
pdecon_4 = Deconstruct(Point=pt_that_form_the_exterior_envelop)  # -> graft(XComponent), graft(YComponent), graft(ZComponent)
pdecon_5 = Deconstruct(Point=pt_that_form_the_exterior_glazing)  # -> graft(XComponent), graft(YComponent), graft(ZComponent)
pdecon_6 = Deconstruct(Point=pt_that_form_the_polygon_of_bldg_footpri)  # -> graft(XComponent), graft(YComponent), graft(ZComponent)
pdecon_7 = Deconstruct(Point=pt_that_form_the_polygon_of_bldg_rooftop)  # -> graft(XComponent), graft(YComponent), graft(ZComponent)
pdecon_8 = Deconstruct(Point=pt_that_form_the_polygon_of_bldg_rooftop_2)  # -> graft(XComponent), graft(YComponent), graft(ZComponent)
lng_12 = ListLength(List=pt_that_form_the_polygon_of_bldg_footpri_2)  # -> flatten(Length)
merge = Merge(Data1=pdecon.XComponent, Data2=pdecon.YComponent, Data3=pdecon.ZComponent)  # -> flatten(Result)
lng_13 = ListLength(List=pt_that_form_the_interior_envelop)  # -> flatten(Length)
lng_14 = ListLength(List=pt_that_form_the_interior_glazing)  # -> flatten(Length)
merge_2 = Merge(Data1=pdecon_2.XComponent, Data2=pdecon_2.YComponent, Data3=pdecon_2.ZComponent)  # -> flatten(Result)
merge_3 = Merge(Data1=pdecon_3.XComponent, Data2=pdecon_3.YComponent, Data3=pdecon_3.ZComponent)  # -> flatten(Result)
lng_15 = ListLength(List=pt_that_form_the_exterior_envelop)  # -> flatten(Length)
lng_16 = ListLength(List=pt_that_form_the_exterior_glazing)  # -> flatten(Length)
merge_4 = Merge(Data1=pdecon_4.XComponent, Data2=pdecon_4.YComponent, Data3=pdecon_4.ZComponent)  # -> flatten(Result)
merge_5 = Merge(Data1=pdecon_5.XComponent, Data2=pdecon_5.YComponent, Data3=pdecon_5.ZComponent)  # -> flatten(Result)
lng_17 = ListLength(List=pt_that_form_the_polygon_of_bldg_footpri)  # -> flatten(Length)
merge_6 = Merge(Data1=pdecon_6.XComponent, Data2=pdecon_6.YComponent, Data3=pdecon_6.ZComponent)  # -> flatten(Result)
lng_18 = ListLength(List=pt_that_form_the_polygon_of_bldg_rooftop)  # -> flatten(Length)
merge_7 = Merge(Data1=pdecon_7.XComponent, Data2=pdecon_7.YComponent, Data3=pdecon_7.ZComponent)  # -> flatten(Result)
panel_13 = Panel(pt_that_form_the_polygon_of_bldg_footpri_2)
lng_19 = ListLength(List=pt_that_form_the_polygon_of_bldg_rooftop_2)  # -> flatten(Length)
multiplication_4 = Multiplication(A=lng_12, B=3)
multiplication_5 = Multiplication(A=lng_13, B=3)
multiplication_6 = Multiplication(A=lng_14, B=3)
multiplication_7 = Multiplication(A=lng_15, B=3)
multiplication_8 = Multiplication(A=lng_16, B=3)
multiplication_9 = Multiplication(A=lng_17, B=3)
merge_8 = Merge(Data1=pdecon_8.XComponent, Data2=pdecon_8.YComponent, Data3=pdecon_8.ZComponent)  # -> flatten(Result)
multiplication_10 = Multiplication(A=lng_18, B=3)
partition = PartitionList(List=merge, Size=multiplication_4)
partition_2 = PartitionList(List=merge_2, Size=multiplication_5)
partition_3 = PartitionList(List=merge_3, Size=multiplication_6)
partition_4 = PartitionList(List=merge_4, Size=multiplication_7)
partition_5 = PartitionList(List=merge_5, Size=multiplication_8)
partition_6 = PartitionList(List=merge_6, Size=multiplication_9)
multiplication_11 = Multiplication(A=lng_19, B=3)
partition_7 = PartitionList(List=merge_7, Size=multiplication_10)
panel_14 = Panel(merge)
partition_8 = PartitionList(List=merge_8, Size=multiplication_11)
space = Text(" ")
space_2 = Text(" ")
space_3 = Text(" ")
space_4 = Text(" ")
space_5 = Text(" ")
space_6 = Text(" ")
space_7 = Text(" ")
space_8 = Text(" ")
join_5 = TextJoin(Text=partition, Join=space)
join_6 = TextJoin(Text=partition_2, Join=space_2)
join_7 = TextJoin(Text=partition_3, Join=space_3)
join_8 = TextJoin(Text=partition_4, Join=space_4)
join_9 = TextJoin(Text=partition_5, Join=space_5)
join_10 = TextJoin(Text=partition_6, Join=space_6)
join_11 = TextJoin(Text=partition_7, Join=space_8)
join_12 = TextJoin(Text=partition_8, Join=space_7)
panel_15 = Panel(join_6)
panel_16 = Panel(join_7)
panel_17 = Panel(join_8)
panel_18 = Panel(join_9)
panel_19 = Panel(join_12)
panel_20 = Panel(join_11)
panel_21 = Panel(join_5)
panel_22 = Panel(join_10)
txt = Text(flatten([join_8, join_6]))
txt_2 = Text(flatten([join_9, join_7]))
python_9 = PythonScript(FacadeXYZ=graft(txt), Facadenumber=rep_5, WindowXYZ=graft(txt_2), Windownumber=rep_6)  # -> flatten(out), a
# ---------- python_9: Python ----------
print '<bldg:boundedBy>'
print '<bldg:WallSurface>'
print '<gml:name>',Facadenumber,'</gml:name>'
print '<bldg:lod3MultiSurface>'
print '<gml:MultiSurface>'
print '<gml:surfaceMember>'
print '<gml:CompositeSurface>'
print '<gml:surfaceMember>'
print '<gml:Polygon>'
print '<gml:exterior>'
print '<gml:LinearRing>'
print '<gml:posList srsDimension="3">', FacadeXYZ, '</gml:posList>'
print '</gml:LinearRing>'
print '</gml:exterior>'
print '</gml:Polygon>'
print '</gml:surfaceMember>'
print '</gml:CompositeSurface>'
print '</gml:surfaceMember>'
print '</gml:MultiSurface>'
print '</bldg:lod3MultiSurface>'
print '<bldg:opening>'
print '<bldg:Window>'
print '<gml:name>',Windownumber,'</gml:name>'
print '<bldg:lod3MultiSurface>'
print '<gml:MultiSurface>'
print '<gml:surfaceMember>'
print '<gml:Polygon>'
print '<gml:exterior>'
print '<gml:LinearRing>'
print '<gml:posList srsDimension="3">', WindowXYZ, '</gml:posList>'
print '</gml:LinearRing>'
print '</gml:exterior>'
print '</gml:Polygon>'
print '</gml:surfaceMember>'
print '</gml:MultiSurface>'
print '</bldg:lod3MultiSurface>'
print '</bldg:Window>'
print '</bldg:opening>'
print '</bldg:WallSurface>'
print '</bldg:boundedBy>'
# ---------- end python_9 ----------
multiplication_12 = Multiplication(A=lng_2, B=40)
partition_9 = PartitionList(List=python_9.out, Size=flatten(multiplication_12))
panel_23 = Panel(partition_9)
citygml_bldg_main_1 = PythonScript(
    bldg_id=rep_2,
    LCX=lcx,
    LCY=lcy,
    LCZ=lcz,
    UCX=ucx,
    UCY=ucy,
    UCZ=ucz,
    Building_id=rep_3,
    bldg_height=bldg_height,
    floorsabvg=of_floors,
    floor_height_abvg=floor_height_2,
    footprint_id1=rep,
    footprint_id2=rep_4,
    footprintPtXYZ1=join_5,
    footprintPtXYZ2=join_10)  # -> flatten(Script_for_CEA_ArcGIS), a
# ---------- citygml_bldg_main_1: Python ----------
print '<cityObjectMember>'
print '<bldg:Building>'
print '<gml:name>', Building_id, '</gml:name>'
print '<gml:boundedBy>'
print '<gml:Envelope srsDimension="3" srsName="urn:ogc:def:crs,crs:EPSG:6.12:3068,crs:EPSG:6.12:5783">'
print '<gml:lowerCorner>',LCX,LCY,LCZ,'</gml:lowerCorner>'
print '<gml:upperCorner>',UCX,UCY,UCZ,'</gml:upperCorner>'
print '</gml:Envelope>'
print '</gml:boundedBy>'
print '<bldg:function'
print 'codeSpace="http://www.sig3d.org/codelists/standard/building/2.0/_AbstractBuilding_function.xml">',function,'</bldg:function>'
print '<bldg:measuredHeight uom="#m">',bldg_height,'</bldg:measuredHeight>'
print '<bldg:storeysAboveGround>',floorsabvg,'</bldg:storeysAboveGround>'
print '<bldg:storeyHeightsAboveGround uom="#m">',floor_height_abvg,'</bldg:storeyHeightsAboveGround>'
print '<bldg:boundedBy>'
print '<bldg:GroundSurface>'
print '<gml:name>',footprint_id1,'</gml:name>'
print '<bldg:lod3MultiSurface>'
print '<gml:MultiSurface>'
print '<gml:surfaceMember>'
print '<gml:Polygon>'
print '<gml:exterior>'
print '<gml:LinearRing>'
print '<gml:posList srsDimension="3">',footprintPtXYZ1,'</gml:posList>'
print '</gml:LinearRing>'
print '</gml:exterior>'
print '</gml:Polygon>'
print '</gml:surfaceMember>'
print '</gml:MultiSurface>'
print '</bldg:lod3MultiSurface>'
print '</bldg:GroundSurface>'
print '<bldg:GroundSurface>'
print '<gml:name>',footprint_id2,'</gml:name>'
print '<bldg:lod3MultiSurface>'
print '<gml:MultiSurface>'
print '<gml:surfaceMember>'
print '<gml:Polygon>'
print '<gml:exterior>'
print '<gml:LinearRing>'
print '<gml:posList srsDimension="3">',footprintPtXYZ2,'</gml:posList>'
print '</gml:LinearRing>'
print '</gml:exterior>'
print '</gml:Polygon>'
print '</gml:surfaceMember>'
print '</gml:MultiSurface>'
print '</bldg:lod3MultiSurface>'
print '</bldg:GroundSurface>'
print '</bldg:boundedBy>'
# ---------- end citygml_bldg_main_1 ----------
citygml_bldg_main_3 = PythonScript(rooftop_id1=rep_7, rooftop_id2=rep_8, rooftopPtXYZ1=join_11, rooftopPtXYZ2=join_12)  # -> flatten(Script_for_CEA_ArcGIS), a
# ---------- citygml_bldg_main_3: Python ----------
print '<bldg:boundedBy>'
print '<bldg:RoofSurface>'
print '<gml:name>',rooftop_id1,'</gml:name>'
print '<bldg:lod3MultiSurface>'
print '<gml:MultiSurface>'
print '<gml:surfaceMember>'
print '<gml:Polygon>'
print '<gml:exterior>'
print '<gml:LinearRing>'
print '<gml:posList srsDimension="3">',rooftopPtXYZ1,'</gml:posList>'
print '</gml:LinearRing>'
print '</gml:exterior>'
print '</gml:Polygon>'
print '</gml:surfaceMember>'
print '</gml:MultiSurface>'
print '</bldg:lod3MultiSurface>'
print '</bldg:RoofSurface>'
print '<bldg:RoofSurface>'
print '<gml:name>',rooftop_id2,'</gml:name>'
print '<bldg:lod3MultiSurface>'
print '<gml:MultiSurface>'
print '<gml:surfaceMember>'
print '<gml:Polygon>'
print '<gml:exterior>'
print '<gml:LinearRing>'
print '<gml:posList srsDimension="3">',rooftopPtXYZ2,'</gml:posList>'
print '</gml:LinearRing>'
print '</gml:exterior>'
print '</gml:Polygon>'
print '</gml:surfaceMember>'
print '</gml:MultiSurface>'
print '</bldg:lod3MultiSurface>'
print '</bldg:RoofSurface>'
print '</bldg:boundedBy>'
print '<bldg:lod3Solid>'
print '<gml:Solid>'
print '<gml:exterior>'
print '<gml:CompositeSurface>'
print '</gml:CompositeSurface>'
print '</gml:exterior>'
print '</gml:Solid>'
print '</bldg:lod3Solid>'
print '</bldg:Building>'
print '</cityObjectMember>'
# ---------- end citygml_bldg_main_3 ----------
citygml_ending = PythonScript()  # -> Script_for_CEA_ArcGIS, a
# ---------- citygml_ending: Python ----------
print '</CityModel>'
# ---------- end citygml_ending ----------
citygml_core = PythonScript()  # -> Script_for_CEA_ArcGIS, a
# ---------- citygml_core: Python ----------
print '<?xml version="1.0" encoding="UTF-8" standalone="yes"?>'
print '<CityModel xmlns="http://www.opengis.net/citygml/2.0"'
print 'xmlns:xsi="http://www.w3.org/2001/XMLSchema-instance"'
print 'xmlns:gml="http://www.opengis.net/gml"'
print 'xmlns:bldg="http://www.opengis.net/citygml/building/2.0"'
print 'xsi:schemaLocation="http://www.opengis.net/citygml/landuse/2.0'
print 'http://www.opengis.net/citygml/building/2.0'
print 'http://schemas.opengis.net/citygml/building/2.0/building.xsd'
print 'http://www.opengis.net/citygml/cityobjectgroup/2.0'
print 'http://schemas.opengis.net/citygml/cityobjectgroup/2.0/cityObjectGroup.xsd'
print 'http://www.opengis.net/citygml/generics/2.0' 
print 'http://schemas.opengis.net/citygml/generics/2.0/generics.xsd">'
# ---------- end citygml_core ----------
citygml_bldg_main_2 = Text(partition_9)
partition_10 = PartitionList(List=citygml_bldg_main_3.Script_for_CEA_ArcGIS, Size=44)
partition_11 = PartitionList(List=citygml_bldg_main_1.Script_for_CEA_ArcGIS, Size=48)
merge_9 = Merge(Data1=partition_11, Data2=citygml_bldg_main_2, Data3=partition_10)  # -> flatten(Result)
merge_10 = Merge(Data1=citygml_core.Script_for_CEA_ArcGIS, Data2=merge_9, Data3=citygml_ending.Script_for_CEA_ArcGIS)
citygml_script_for_cea_arcgis = Panel(merge_10)
# City Energy Analyst (CEA)
citygml_schema = Text(merge_10)

# ----
# Optimization engine
galapagos = Galapagos(gene=[floor_area_ratio, site_coverage, bldg_perimeter_factor])
